# Grasshopper definition GV V6 colibri.gh (Grasshopper 1.0.8)
# plug-ins: RhinoCodePluginGH, Pufferfish, CORE.Grasshopper.Colibri, LunchBoxML, ShapeMap1.0, LunchBox, Kangaroo2 Components

panel = Panel("10;12;13;15;13;9;9;6;11;9;11;14;15;12;10;14;13;6;11;8;8;10;6;12;7;12;7;11;14;9;7;9;8;12;15;10;13;10;14;8;15;12;14;12;7;10;9;6;9;12;13;7;12;7;11;10;6;11;8;14;10;9;11;8;13;11;13;7;8;9;12;11;13;15;14;7;8;6;14;7;7;11;11;10;8;7;12;10;9;15;8;13;10;14;8;14;13;13;9;14")
panel_2 = Panel("165;182;181;158;160;219;214;151;205;190;186;154;188;241;220;218;250;230;174;195;197;216;162;249;233;235;243;209;225;199;166;153;155;159;236;189;173;185;208;215;226;164;180;178;206;247;201;246;203;204;172;237;222;217;200;227;238;161;192;207;211;167;245;187;169;163;248;184;240;175;229;171;231;221;210;232;170;191;177;242;157;194;244;193;168;213;202;196;183;212;198;176;223;234;224;152;228;239;156;179")
index = Slider(1, range=0..99)
split = TextSplit(Text=panel, Separators=";")
split_2 = TextSplit(Text=panel_2, Separators=";")
item = ListItem(List=split_2, Index=index, Wrap=True)  # -> flatten(Item)
item_2 = ListItem(List=split, Index=index, Wrap=True)  # -> flatten(Item)

panel_3 = Panel("""173
144
108
132
131
197
102
153
141
127
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""")
index_2 = Slider(26, range=0..99)
item_3 = ListItem(List=panel_3, Index=index_2, Wrap=True)  # -> flatten(Item)
panel_4 = Panel(item_3)
division = Division(A=item_3, B="1000")
division_2 = Division(A=item, B="1000")
division_3 = Division(A=item_2, B="1000")
amplitude = Slider(0.07, range=0.01..0.1)
amplitude_2 = Slider(0.07, range=0.01..0.1)
vault_thickness = Slider(0.1, range=0.1..0.25)
interlaayer_thickness = Slider(0.01, range=0.006..0.015)
wall_thickness = Panel("0.2")
block_width = Panel(wall_thickness)
block_amplitude = Panel("0.6")
block_width_2 = Panel("0.150")
block_length = Panel("0.300")
block_height = Panel("0.200")
wall_height = Panel("1.8")
wall_length = Panel("1.2")
arch_height_m = Panel("1.9")
arch_span_m = Panel("2.2")
vault_length = Panel("1.2")
block_amplitude_2 = Panel("0.6")
block_width_3 = Panel(vault_thickness)
block_length_2 = Panel("0.300")
block_height_2 = Panel("0.200")

amplitude_3 = Slider(0.07, range=0.01..0.1)
block_length_3 = Slider(0.3, range=0.1..0.3)
block_width_4 = Panel("0.300")

# ---- group: OUTER ARCH
arch_height_m_2 = Panel("3.0")
vault_length_2 = Panel("2")
arch_span_m_2 = Panel("1.6")

# ---- group: TENTATIVE
block_width_5 = Panel("0.150")
block_length_4 = Panel("0.300")
block_height_3 = Panel("0.200")

# ----
wall_thickness_2 = Panel("0.2")
wall_height_2 = Panel("1.8")
wall_length_2 = Panel("1.2")

arch_height_m_3 = Panel("4.0")
arch_span_m_3 = Panel("2.2")
vault_length_3 = Panel("1.2")

block_length_5 = Panel("0.300")
block_height_4 = Panel("0.200")

panel_5 = Panel([arch_span_m, arch_height_m, vault_length])

pt = Point("0,0,0")
division_4 = Division(A=arch_span_m_3, B="2")
X = UnitX(Factor=expr("-x", division_4))
X_2 = UnitX(Factor=division_4)
move = Move(Geometry=pt, Motion=X)  # -> Geometry, Transform
move_2 = Move(Geometry=pt, Motion=X_2)  # -> Geometry, Transform
cat = Catenary(PointA=move_2.Geometry, PointB=move.Geometry, Length=arch_height_m_3, Gravity=Vector(0, 0, -1))
xy = XYPlane(Origin=Point(0, 0, 0))
mirror = Mirror(Geometry=cat, Plane=xy)  # -> Geometry, Transform

panel_6 = Panel([vault_thickness, block_amplitude_2, block_width_3, block_length_2, block_height_2])
block_amplitude_3 = Panel([wall_length, wall_height, wall_thickness, block_width, amplitude])

# ---- group: Point Grid
pt_2 = Point()

# ----
Y = UnitY(Factor=".5")
split_3 = SplitTree(Data=pt_2, Masks=flatten("{0,2,...}"))  # -> Positive, Negative
rev = Reverse(Vector=Y)
move_3 = Move(Geometry=split_3.Positive, Motion=Y)  # -> Geometry, Transform
move_4 = Move(Geometry=split_3.Negative, Motion=rev)  # -> Geometry, Transform

# ---- group: SINE COSINE CURVE
series = Series(Start=0, Step=Slider(0.1, range=0..1), Count=Slider(67, range=0..100))
hilonums = HighestLowestNumbers(Numbers=series)  # -> Highest, Lowest
division_5 = Division(A=hilonums.Highest, B="2")
expression = Expression(x=series, Expression="sin(x-π/2)")
pi = Pi(Factor="2")
pt_3 = ConstructPoint(XCoordinate=series, YCoordinate=expression, ZCoordinate=0)
item_4 = ListItem(List=pt_3, Index=0, Wrap=True)
X_3 = UnitX(Factor=pi)
intcrv = Interpolate(Vertices=pt_3, Degree=3, Periodic=False, KnotStyle=1)  # -> Curve, Length, Domain
move_5 = Move(Geometry=item_4, Motion=X_3)  # -> Geometry, Transform
ptstrimcrv = PointsTrimCurve(Curve=intcrv.Curve, Points=move_5.Geometry, Flip=False)  # -> Trimmed, SubDomains, Intersected

# ---- group: base arch rectangles
end = EndPoints(Curve=mirror.Geometry)  # -> Start, End
Y_2 = UnitY(Factor=vault_length_3)
move_6 = Move(Geometry=end.End, Motion=Y_2)  # -> Geometry, Transform
move_7 = Move(Geometry=end.Start, Motion=Y_2)  # -> Geometry, Transform
ln = Line(StartPoint=end.End, EndPoint=move_6.Geometry)
ln_2 = Line(StartPoint=end.Start, EndPoint=move_7.Geometry)
X_4 = UnitX(Factor=division)
extr = Extrude(Base=ln, Direction=expr("-x", X_4))
extr_2 = Extrude(Base=ln_2, Direction=expr("-x", X_4))

# ---- group: SINE COSINE CURVE
series_2 = Series(Start=0, Step=Slider(0.1, range=0..1), Count=Slider(67, range=0..100))
hilonums_2 = HighestLowestNumbers(Numbers=series_2)  # -> Highest, Lowest
division_6 = Division(A=hilonums_2.Highest, B="2")
expression_2 = Expression(x=series_2, Expression="sin(x-π/2)")
pi_2 = Pi(Factor="2")
pt_4 = ConstructPoint(XCoordinate=series_2, YCoordinate=expression_2, ZCoordinate=0)
item_5 = ListItem(List=pt_4, Index=0, Wrap=True)
X_5 = UnitX(Factor=pi_2)
intcrv_2 = Interpolate(Vertices=pt_4, Degree=3, Periodic=False, KnotStyle=1)  # -> Curve, Length, Domain
move_8 = Move(Geometry=item_5, Motion=X_5)  # -> Geometry, Transform
ptstrimcrv_2 = PointsTrimCurve(Curve=intcrv_2.Curve, Points=move_8.Geometry, Flip=False)  # -> Trimmed, SubDomains, Intersected

# ----
arch_height_m_4 = Panel("4.0")
arch_span_m_4 = Panel("2.2")
vault_length_4 = Panel("2")

block_width_7 = Panel("0.150")
block_length_6 = Panel("0.300")
block_height_5 = Panel("0.200")

pt_5 = Point("0,0,0")
division_7 = Division(A=arch_span_m_4, B="2")
X_6 = UnitX(Factor=expr("-x", division_7))
X_7 = UnitX(Factor=division_7)
move_9 = Move(Geometry=pt_5, Motion=X_7)  # -> Geometry, Transform
move_10 = Move(Geometry=pt_5, Motion=X_6)  # -> Geometry, Transform
cat_2 = Catenary(PointA=move_9.Geometry, PointB=move_10.Geometry, Length=arch_height_m_4, Gravity=Vector(0, 0, -1))
xy_2 = XYPlane(Origin=Point(0, 0, 0))
mirror_2 = Mirror(Geometry=cat_2, Plane=xy_2)  # -> Geometry, Transform

len = Length(Curve=mirror_2.Geometry)
division_8 = Division(A=len, B=block_height_5)
division_9 = Division(A=vault_length_4, B=block_length_6)
round = Round(Number=division_9)  # -> Nearest, Floor, Ceiling
round_2 = Round(Number=division_8)  # -> Nearest, Floor, Ceiling
py3 = Python3Script(x=round_2.Nearest)  # -> out, a
# ---------- py3: Python ----------
import rhinoscriptsyntax as rs

def make_ODD(n):
    if n % 2 == 0:  # Check if the number is even
        return n + 1  # Add 1 to make it odd
    return n  # If it's already odd, return as is

# Grasshopper input
n = x  # 'x' is the input number in the Grasshopper component
a = make_ODD(n)  # Output the processed number
# ---------- end py3 ----------

offset = OffsetCurve(Curve=mirror_2.Geometry, Distance=expr("-x", block_width_7), Corners=1)
crv = Curve(offset)
crv_2 = Curve(mirror_2.Geometry)
divide = DivideCurve(Curve=crv_2, Count=py3.a, Kinks=False)  # -> Points, Tangents, Parameters
crv_cp = CurveClosestPoint(Point=divide.Points, Curve=crv)  # -> Point, Parameter, Distance
shatter = Shatter(Curve=crv_2, Parameters=divide.Parameters)
shatter_2 = Shatter(Curve=crv, Parameters=crv_cp.Parameter)
ln_3 = Line(StartPoint=divide.Points, EndPoint=crv_cp.Point)
crv_3 = Curve(ln_3)
cull_i = CullIndex(List=crv_3, Indices="-1", Wrap=True)
cull_i_2 = CullIndex(List=crv_3, Indices="0", Wrap=True)
weave = Weave(Pattern=[0, 1, 2, 3], Stream0=cull_i, Stream1=shatter, Stream2=cull_i_2, Stream3=shatter_2, NullGaps=False)
partition = PartitionList(List=weave, Size="4")
join = JoinCurves(Curves=partition, Preserve=False)
boundary = BoundarySurfaces(Edges=join)
Y_3 = UnitY(Factor=vault_length_4)
extr_3 = Extrude(Base=boundary, Direction=Y_3)  # -> flatten(Extrusion)

panel_7 = Panel(join)

panel_8 = Panel("""9
6
16
14
10
23
17
14
13
7
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""")
panel_9 = Panel("""240
190
160
230
290
220
210
270
300
280
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""")
index_3 = Slider(24, range=0..99)
item_6 = ListItem(List=panel_8, Index=index_3, Wrap=True)  # -> flatten(Item)
item_7 = ListItem(List=panel_9, Index=index_3, Wrap=True)  # -> flatten(Item)
division_10 = Division(A=item_6, B="1000")
division_11 = Division(A=item_7, B="1000")

panel_10 = Panel("2")  # disabled
arch_thickness = Slider(0.1, range=0.1..0.5)
interlaayer_thickness_2 = Slider(0.005, range=0.005..0.025)

block_height_6 = Panel("0.200")

arch_height_m_5 = Panel("4.0")
arch_span_m_5 = Panel("2.2")

dom = ConstructDomain(DomainStart=0, DomainEnd=vault_length_3)  # disabled
dom_2 = ConstructDomain(DomainStart=0, DomainEnd=arch_height_m_3)  # disabled
dom_3 = ConstructDomain(DomainStart=0, DomainEnd=arch_span_m_3)  # disabled
box = DomainBox(Base=PlaneXY(0, 0, 0), X=dom_3, Y=dom, Z=dom_2)  # disabled
box_2 = DomainBox(Base=PlaneXY(0, 0, 0), X=Domain(-2, 2), Y=Domain(-1, 1), Z=dom_2)  # disabled
sdiff = SolidDifference(BrepsA=box_2, BrepsB=box)  # disabled

# ---- group: without interlayer / 2D
item_8 = ListItem(List=flatten(boundary), Index=0, Wrap=True)  # -> Item1, Item
planesrf = PlaneSurface(Plane=PlaneXY(0, 0, 0), XSize=Domain(-10, 10), YSize=Domain(-10, 10))
split_4 = SplitBrep(Brep=[item_8.Item1, item_8.Item], Cutter=planesrf)

# ---- group: without interlayer
panel_11 = Panel(split_4)
item_9 = ListItem(List=split_4, Index=0, Wrap=True)
index_4 = ItemIndex(List=flatten(boundary), Item=[item_8.Item1, item_8.Item])
brep = Brep(flatten(item_9))
item_10 = ListItem(List=brep, Index=0, Wrap=True)  # -> Item, Item1
replace = ReplaceItems(List=flatten(boundary), Item=[item_10.Item1, item_10.Item], Indices=index_4, Wrap=False)
brep_2 = Brep(flatten(replace))

# ----
dom_4 = ConstructDomain(DomainStart=0, DomainEnd=vault_length_3)  # disabled
dom_5 = ConstructDomain(DomainStart=0, DomainEnd=arch_height_m_3)  # disabled
dom_6 = ConstructDomain(DomainStart=0, DomainEnd=arch_span_m_3)  # disabled
box_3 = DomainBox(Base=PlaneXY(0, 0, 0), X=dom_6, Y=dom_4, Z=dom_5)  # disabled
box_4 = DomainBox(Base=PlaneXY(0, 0, 0), X=Domain(-2, 2), Y=Domain(-1, 1), Z=dom_5)  # disabled
sdiff_2 = SolidDifference(BrepsA=box_4, BrepsB=box_3)  # disabled

py3_2 = Python3Script()  # -> out, a; inputs geometry: list of Brep; disabled
# ---------- py3_2: Python ----------
import Rhino
import scriptcontext as sc
import System
import os

def export_step(geo_input, export_path, T_value, I_value):
    sc.doc = Rhino.RhinoDoc.ActiveDoc

    # Create a file name from slider values
    file_name = f"T{T_value}I{I_value}"
    full_path = os.path.join(export_path, file_name + ".step")

    # Wrap single input in list if necessary
    geo_list = geo_input if isinstance(geo_input, list) else [geo_input]

    obj_ids = []
    success = False

    print(f"Number of Breps: {len(geo_list)}")

    # Create a temporary layer for exporting
    temp_layer_name = "Temp_Export_Layer"
    temp_layer_index = sc.doc.Layers.FindByFullPath(temp_layer_name, True)
    if temp_layer_index == -1:
        temp_layer_index = sc.doc.Layers.Add(temp_layer_name, System.Drawing.Color.Red)

    for i, geo in enumerate(geo_list):
        print(f"Processing Brep {i}...")
        if not geo.IsValid:
            print(f"❌ Brep {i} is invalid, skipping")
            continue

        if isinstance(geo, Rhino.Geometry.Brep):
            attr = Rhino.DocObjects.ObjectAttributes()
            attr.LayerIndex = temp_layer_index
            guid = sc.doc.Objects.AddBrep(geo, attr)
        else:
            print(f"⚠️ Unsupported geometry type at index {i}: {type(geo)}")
            continue

        if guid != System.Guid.Empty:
            obj_ids.append(guid)

    if obj_ids:
        # Select all added objects
        for guid in obj_ids:
            sc.doc.Objects.Select(guid, True)

        # Run export command
        export_command = f'-_Export "{full_path}" _Enter'
        success = Rhino.RhinoApp.RunScript(export_command, False)
        print(f"Export command success: {success}")

    # Clean up: delete added objects
    for guid in obj_ids:
        sc.doc.Objects.Delete(guid, True)

    # Delete the temporary layer (if empty)
    try:
        if temp_layer_index != -1:
            layer = sc.doc.Layers[temp_layer_index]
            if layer and not layer.IsDeleted:
                sc.doc.Layers.Delete(temp_layer_index, True)
    except Exception as e:
        print(f"⚠️ Could not delete temp layer: {e}")

    return "✅ Exported: " + full_path if success else "❌ Export failed"

# === INPUTS from Grasshopper ===
geometry = geometry
T = int(thickness)
I = int(interlayer_stiffness)
export_path = r'D:\ANSYS BT\06 Arch2Dparametric hollow brick\geometry dataset'

a = export_step(geometry, export_path, T, I)
# ---------- end py3_2 ----------
toggle = BooleanToggle(False)  # disabled

# ----
# FORM-GLOBAL
number_slider = Slider(0.1, range=0..1)
pt_6 = Point("0,0,0")
X_8 = UnitX(Factor=1)
line = LineSDL(Start=pt_6, Direction=X_8, Length="3000")
panel_12 = Panel("Length of brick")
division_12 = Division(B="2")

length = Panel("5")
minimum_width = Panel("1.6")
addition = Addition(A=minimum_width, B=number_slider)

division_13 = Division(A=length, B="2")
division_14 = Division(A=minimum_width, B="2")
X_9 = UnitX(Factor=expr("-x", "1.2"))
X_10 = UnitX(Factor=expr("-x", division_14))
X_11 = UnitX(Factor=expr("-x", number_slider))
Y_4 = UnitY(Factor=expr("-x", division_13))
Y_5 = UnitY(Factor=division_13)
move_11 = Move(Geometry=pt_6, Motion=X_10)  # -> Geometry, Transform
move_12 = Move(Geometry=pt_6, Motion=X_9)  # -> Geometry, Transform
move_13 = Move(Geometry=move_12.Geometry, Motion=Y_5)  # -> Geometry, Transform
move_14 = Move(Geometry=move_12.Geometry, Motion=Y_4)  # -> Geometry, Transform
move_15 = Move(Geometry=[move_13.Geometry, move_14.Geometry], Motion=X_11)  # -> Geometry, Transform
item_11 = ListItem(List=move_15.Geometry, Index=0, Wrap=True)  # -> Item, Item1
intcrv_3 = Interpolate(Vertices=[item_11.Item, move_11.Geometry, item_11.Item1], Degree=3, Periodic=False, KnotStyle=1)  # -> Curve, Length, Domain
yz = YZPlane(Origin=Point(0, 0, 0))
height_max = Panel("2")
mirror_3 = Mirror(Geometry=intcrv_3.Curve, Plane=yz)  # -> Geometry, Transform
end_2 = EndPoints(Curve=mirror_3.Geometry)  # -> Start, End
end_3 = EndPoints(Curve=intcrv_3.Curve)  # -> Start, End
Z = UnitZ(Factor=height_max)
ln_4 = Line(StartPoint=end_2.Start, EndPoint=end_3.Start)
midpt = CurveMiddle(Curve=ln_4)
move_16 = Move(Geometry=midpt, Motion=Z)  # -> Geometry, Transform
intcrv_4 = Interpolate(Vertices=[end_2.Start, move_16.Geometry, end_3.Start], Degree=3, Periodic=False, KnotStyle=1)  # -> Curve, Length, Domain
len_2 = Length(Curve=intcrv_4.Curve)
length_of_arc = Panel(len_2)
cat_3 = Catenary(PointA=end_2.Start, PointB=end_3.Start, Length=length_of_arc, Gravity=expr("-X", Vector(0, 0, -1)))
swp2 = Sweep2(Rail1=mirror_3.Geometry, Rail2=intcrv_3.Curve, Sections=cat_3, SameHeight=False)

angle = Slider(45, range=0..180)
end_4 = EndPoints(Curve=cat_3)  # -> Start, End
yz_2 = YZPlane(Origin=end_4.Start)
xz = XZPlane(Origin=end_4.Start)
multiplication = Multiplication(A=angle, B="0.0174533")
rotate = Rotate(Geometry=xz, Angle=multiplication, Plane=yz_2)  # -> Geometry, Transform
sec = BrepPlane(Brep=swp2, Plane=rotate.Geometry)  # -> Curves, Points
xz_2 = XZPlane(Origin=Point(0, 0, 0))
mirror_4 = Mirror(Geometry=sec.Curves, Plane=xz_2)  # -> Geometry, Transform
srfsplit = SurfaceSplit(Surface=swp2, Curves=[mirror_4.Geometry, sec.Curves])
item_12 = ListItem(List=srfsplit, Index=0, Wrap=True)  # -> Item, Item1, Item2
srf = Surface(item_12.Item2)

project = Project(Geometry=srf, Plane=PlaneXY(0, 0, 0))  # -> Geometry, Transform
edges = BrepEdges(Brep=project.Geometry)  # -> Naked, Interior, NonManifold
reb = RebuildCurve(Curve=edges.Naked, Degree="3", Count="36", Tangents=False)
item_13 = ListItem(List=reb, Index=0, Wrap=True)  # -> Item, Item1, Item2, Item3
edgesrf = EdgeSurface(CurveA=item_13.Item, CurveB=item_13.Item1, CurveC=item_13.Item2, CurveD=item_13.Item3)
crv_4 = Curve(item_13.Item)

item_14 = ListItem(List=edges.Naked, Index=0, Wrap=True)  # -> Item, Item1
len_3 = Length(Curve=item_14.Item1)
division_15 = Division(A=len_3, B=division_12)
round_3 = Round(Number=division_15)  # -> Nearest, Floor, Ceiling
panel_13 = Panel(round_3.Nearest)
reb_2 = RebuildCurve(Curve=[item_14.Item, item_14.Item1], Degree="3", Count=round_3.Nearest, Tangents=False)
crv_5 = Curve([item_13.Item2, item_13.Item3])
crv_6 = Curve(item_13.Item1)
crv_7 = Curve([item_13.Item, item_13.Item2])

# ----
# FORM-CATENARY VAULT
# TESSELLATION-CATENARY VAULT
# CLUSTERING
# FABRICATION
panel_14 = Panel("2")
division_16 = Division(A=minimum_width, B=panel_14)
X_12 = UnitX(Factor=expr("-x", division_16))
X_13 = UnitX(Factor=division_16)
move_17 = Move(Geometry=pt_6, Motion=X_12)  # -> Geometry, Transform
move_18 = Move(Geometry=pt_6, Motion=X_13)  # -> Geometry, Transform
cat_4 = Catenary(PointA=move_18.Geometry, PointB=move_17.Geometry, Length=Slider(2.85, range=1.7..9.9), Gravity=Vector(0, 0, -1))
xy_3 = XYPlane(Origin=Point(0, 0, 0))
mirror_5 = Mirror(Geometry=cat_4, Plane=xy_3)  # -> Geometry, Transform
Y_6 = UnitY(Factor=Slider(3, range=0..10))
move_19 = Move(Geometry=mirror_5.Geometry, Motion=Y_6)  # -> Geometry, Transform
loft = Loft(
    Curves=[move_19.Geometry, mirror_5.Geometry],
    Options={Adjust=False, Closed=False, LoftEnds=0, LoftSimp=0, LoftType=0, Rebuild=10, Refit=0.01})
extr_4 = Extrude(Base=mirror_5.Geometry, Direction=Y_6)
brep_3 = Brep(extr_4)
shapesolver = ShapeSolver(Shape=brep_3, Method=1, Fineness=Slider(10, range=0..100), Tolerance=0.001)  # -> Info, Code, SolveData
end_5 = EndPoints(Curve=move_19.Geometry)  # -> Start, End
end_6 = EndPoints(Curve=mirror_5.Geometry)  # -> Start, End
line_2 = Line(Line((0.808135616, 2.010362528, 0), (0.808135616, 0.04508756185, 0)))
line_3 = Line(Line((1.101839101, 5.56070372, 0), (1.101839101, 2.757012496, 0)))
length_of_brick = Panel("0.3")
height_of_brick = Panel("0.2")
dist = Distance(PointA=end_5.Start, PointB=end_6.Start)
ln_5 = Line(StartPoint=end_6.Start, EndPoint=end_5.Start)
ln_6 = Line(StartPoint=end_6.End, EndPoint=end_5.End)
shapemap = ShapeMap(SolveData=shapesolver.SolveData, Line0=line_2, Line1=line_3, Area=Toggle(True))  # -> MapData, Border
len_4 = Length(Curve=move_19.Geometry)
division_17 = Division(A=len_4, B=height_of_brick)
division_18 = Division(A=dist, B=length_of_brick)
crv_8 = Curve(shapemap.Border)
round_4 = Round(Number=division_17)  # -> Nearest, Floor, Ceiling
round_5 = Round(Number=division_18)  # -> Nearest, Floor, Ceiling
py3_3 = Python3Script(x=round_4.Ceiling)  # -> out, a
# ---------- py3_3: Python ----------
import rhinoscriptsyntax as rs

def make_even(n):
    if n % 2 == 1:  # Check if the number is odd
        return n + 1  # Add 1 to make it even
    return n  # If it's already even, return as is

# Grasshopper input
n = x  # 'x' is the input number in the Grasshopper component
a = make_even(n)  # Output the processed number
# ---------- end py3_3 ----------
number_slider_2 = Slider(0.1, range=0..0.1)
X_14 = UnitX(Factor=expr("-x", number_slider_2))
X_15 = UnitX(Factor=number_slider_2)
move_20 = Move(Geometry=ln_5, Motion=X_14)  # -> Geometry, Transform
move_21 = Move(Geometry=ln_6, Motion=X_15)  # -> Geometry, Transform
md_slider = MDSlider(SliderMode=0, slider_value=Point(0.5, 0.5, 0.5), x_domain=Domain(0, 1), y_domain=Domain(0, 1), z_domain=Domain(0, 1))
md_slider_2 = MDSlider(SliderMode=0, slider_value=Point(0.5, 0.5, 0.5), x_domain=Domain(0, 1), y_domain=Domain(0, 1), z_domain=Domain(0, 1))
number_slider_3 = Slider(10, range=0..10)
number_slider_4 = Slider(0.6, range=0.5..1)
number_slider_5 = Slider(1, range=0..1)
panel_15 = Panel("""-b
-t""")
number_slider_6 = Slider(20, range=0..100)
number_slider_7 = Slider(10, range=0..50)

loft_2 = Loft(
    Curves=[ln_5, move_20.Geometry],
    Options={Adjust=False, Closed=False, LoftEnds=0, LoftSimp=0, LoftType=0, Rebuild=10, Refit=0.01})
loft_3 = Loft(
    Curves=[ln_6, move_21.Geometry],
    Options={Adjust=False, Closed=False, LoftEnds=0, LoftSimp=0, LoftType=0, Rebuild=10, Refit=0.01})

# ----
# CATENARY ARCH- OSTEOMORPHIC BRICKS
amplitude_4 = Slider(0.06, range=0.01..0.1)
interlayer = Panel("0.010")
len_5 = Length(Curve=mirror.Geometry)
Z_2 = UnitZ(Factor=len_5)
move_22 = Move(Geometry=pt, Motion=Z_2)  # -> Geometry, Transform
xz_3 = XZPlane(Origin=Point(0, 0, 0))
move_23 = Move(Geometry=extr, Motion=X_4)  # -> Geometry, Transform
xz_4 = XZPlane(Origin=Point(0, 0, 0))
panel_16 = Panel("""2
2
2""")
panel_17 = Panel("""0
-1""")

# ---- group: number of rows calculation
division_19 = Division(A=len_5, B=block_height_4)
round_6 = Round(Number=division_19)  # -> Nearest, Floor, Ceiling
subtraction = Subtraction(A=round_6.Nearest, B="1")
multiplication_2 = Multiplication(A=subtraction, B=interlaayer_thickness)
subtraction_2 = Subtraction(A=len_5, B=multiplication_2)
division_20 = Division(A=subtraction_2, B=block_height_4)
round_7 = Round(Number=division_20)  # -> Nearest, Floor, Ceiling
py3_4 = Python3Script(x=round_7.Floor)  # -> out, a; same code as py3

# ----
# WALL WITH OSTEOMORPHIC BRICK
# interlayer
# w/o interlayer
panel_18 = Panel("0,0,0")
pt_7 = Point(panel_18)
multiplication_3 = Multiplication(A=block_width_4, B="5")
division_21 = Division(A=block_width_4, B="3")
multiplication_4 = Multiplication(A=block_length_3, B="5")
Z_3 = UnitZ(Factor=wall_height_2)
move_24 = Move(Geometry=pt_7, Motion=Z_3)  # -> Geometry, Transform
xz_5 = XZPlane(Origin=Point(0, 0, 0))
xz_6 = XZPlane(Origin=Point(0, 0, 0))

max_amplitude = Panel(division_21)
wall_length_3 = Panel(multiplication_4)
wall_height_3 = Panel(multiplication_3)

# ----
# CATENARY VAULT- ANGULAR BRICKS
panel_19 = Panel("0,0,0")
pt_8 = Point(panel_19)
md_slider_3 = MDSlider(SliderMode=0, slider_value=Point(0.5, 0.5, 0.5), x_domain=Domain(0, 1), y_domain=Domain(0, 1), z_domain=Domain(0, 1))
md_slider_4 = MDSlider(SliderMode=0, slider_value=Point(0.5, 0.5, 0.5), x_domain=Domain(0, 1), y_domain=Domain(0, 1), z_domain=Domain(0, 1))

division_22 = Division(A=arch_span_m_2, B="2")
X_16 = UnitX(Factor=expr("-x", division_22))
X_17 = UnitX(Factor=division_22)
move_25 = Move(Geometry=pt_8, Motion=X_16)  # -> Geometry, Transform
move_26 = Move(Geometry=pt_8, Motion=X_17)  # -> Geometry, Transform
cat_5 = Catenary(PointA=move_26.Geometry, PointB=move_25.Geometry, Length=arch_height_m_2, Gravity=Vector(0, 0, -1))
xy_4 = XYPlane(Origin=Point(0, 0, 0))
mirror_6 = Mirror(Geometry=cat_5, Plane=xy_4)  # -> Geometry, Transform
Y_7 = UnitY(Factor=vault_length_2)
move_27 = Move(Geometry=mirror_6.Geometry, Motion=Y_7)  # -> Geometry, Transform
loft_4 = Loft(
    Curves=[move_27.Geometry, mirror_6.Geometry],
    Options={Adjust=False, Closed=False, LoftEnds=0, LoftSimp=0, LoftType=0, Rebuild=10, Refit=0.01})
extr_5 = Extrude(Base=mirror_6.Geometry, Direction=Y_7)
brep_4 = Brep(extr_5)

# ---- group: DIIVISIONS
len_6 = Length(Curve=mirror_6.Geometry)
division_23 = Division(A=len_6, B=block_height_3)
division_24 = Division(A=vault_length_2, B=block_length_4)
round_8 = Round(Number=division_23)  # -> Nearest, Floor, Ceiling
py3_5 = Python3Script(x=round_8.Nearest)  # -> out, a; same code as py3

# ----
offset_2 = OffsetCurve(Curve=move_27.Geometry, Distance=expr("-x", block_width_5), Corners=1)
offset_3 = OffsetCurve(Curve=mirror_6.Geometry, Distance=expr("-x", block_width_5), Corners=1)

loft_5 = Loft(
    Curves=[offset_3, offset_2],
    Options={Adjust=False, Closed=False, LoftEnds=0, LoftSimp=0, LoftType=0, Rebuild=10, Refit=0.01})
xy_5 = XYPlane(Origin=Point(0, 0, 0))
sec_2 = BrepPlane(Brep=loft_5, Plane=xy_5)  # -> Curves, Points
loft_6 = Loft(Curves=sec_2.Curves, Options={Adjust=False, Closed=False, LoftEnds=0, LoftSimp=0, LoftType=0, Rebuild=10, Refit=0.01})
split_5 = SplitBrep(Brep=loft_5, Cutter=loft_6)
item_15 = ListItem(List=split_5, Index=0, Wrap=True)  # -> Item, Item1
brep_5 = Brep(item_15.Item1)

number_slider_8 = Slider(10, range=0..100)
brep_6 = Brep(brep_4)
shapesolver_2 = ShapeSolver(Shape=brep_6, Method=1, Fineness=number_slider_8, Tolerance=0.001)  # -> Info, Code, SolveData
toggle_2 = BooleanToggle(True)
line_4 = Line(Line((-10.19581265, 2.500069582, 0), (-10.13721239, 2.347100181, 0)))
line_5 = Line(Line((-16.17301178, 2.597533464, 0), (-16.15171968, 2.435113408, 0)))
shapemap_2 = ShapeMap(SolveData=shapesolver_2.SolveData, Line0=line_4, Line1=line_5, Area=toggle_2)  # -> MapData, Border
crv_9 = Curve(shapemap_2.Border)
bbox = BoundingBox(Content=crv_9, Plane=PlaneXY(0, 0, 0))  # -> Box, Box_2
srf_2 = Surface(bbox.Box)
crv_10 = Curve(srf_2)
quadstag = StaggeredQuadPanels(Surface=crv_10, UDivisions=division_24, VDivisions=py3_5.a)
rint = RegionIntersection(CurvesA=quadstag, CurvesB=crv_9)
maptoshape = MapToShape(MapData=shapemap_2.MapData, Geometry=rint, Length=1, Pull=False)  # -> flatten(Geometry), Normal

# ---- group: get directions
divide_2 = DivideCurve(Curve=mirror_6.Geometry, Count=py3_5.a, Kinks=False)  # -> Points, Tangents, Parameters
divide_3 = DivideCurve(Curve=move_27.Geometry, Count=py3_5.a, Kinks=False)  # -> Points, Tangents, Parameters
intcrv_5 = Interpolate(Vertices=divide_2.Points, Degree=1, Periodic=False, KnotStyle=1)  # -> Curve, Length, Domain
intcrv_6 = Interpolate(Vertices=divide_3.Points, Degree=1, Periodic=False, KnotStyle=1)  # -> Curve, Length, Domain
explode = Explode(Curve=intcrv_5.Curve, Recursive=True)  # -> Segments, Vertices
explode_2 = Explode(Curve=intcrv_6.Curve, Recursive=True)  # -> Segments, Vertices
weave_2 = Weave(Pattern=[0, 1], Stream0=explode_2.Segments, Stream1=explode.Segments, NullGaps=False)
partition_2 = PartitionList(List=weave_2, Size=2)
loft_7 = Loft(Curves=partition_2, Options={Adjust=False, Closed=False, LoftEnds=0, LoftSimp=0, LoftType=0, Rebuild=10, Refit=0.01})

# ----
explode_3 = Explode(Curve=maptoshape.Geometry, Recursive=True)  # -> Segments, Vertices
item_16 = ListItem(List=explode_3.Vertices, Index=0, Wrap=True)  # -> Item, Item1, Item2, Item3
addition_2 = Addition(A=division_24, B="1")
srf4pt = _4PointSurface(CornerA=item_16.Item, CornerB=item_16.Item1, CornerC=item_16.Item2, CornerD=item_16.Item3)  # -> flatten(Surface)
partition_3 = PartitionList(List=srf4pt, Size=flatten([division_24, addition_2]))

division_25 = Division(A=wall_thickness_2, B="2")
subtraction_3 = Subtraction(A=block_width_4, B=amplitude_3)
Y_8 = UnitY(Factor=division_25)
X_18 = UnitX(Factor=wall_length_2)
division_26 = Division(A=wall_height_2, B=subtraction_3)
move_28 = Move(Geometry=pt_7, Motion=Y_8)  # -> Geometry, Transform
move_29 = Move(Geometry=move_28.Geometry, Motion=X_18)  # -> Geometry, Transform
ln_7 = Line(StartPoint=move_28.Geometry, EndPoint=move_29.Geometry)
Z_4 = UnitZ(Factor=subtraction_3)
division_27 = Division(A=wall_length_2, B=block_length_3)
round_9 = Round(Number=division_27)  # -> Nearest, Floor, Ceiling

end_7 = EndPoints(Curve=ptstrimcrv.Trimmed)  # -> Start, End
ln_8 = Line(StartPoint=end_7.Start, EndPoint=end_7.End)
Y_9 = UnitY(Factor="1")
move_30 = Move(Geometry=ln_8, Motion=Y_9)  # -> Geometry, Transform
divide_4 = DivideCurve(Curve=ptstrimcrv.Trimmed, Count="10", Kinks=False)  # -> Points, Tangents, Parameters
crv_cp_2 = CurveClosestPoint(Point=divide_4.Points, Curve=ln_8)  # -> Point, Parameter, Distance
dist_2 = Distance(PointA=divide_4.Points, PointB=crv_cp_2.Point)
bnd = Bounds(Numbers=dist_2)

division_28 = Division(A=amplitude_3, B="2")
neg = Negative(Value=division_28)
dom_7 = ConstructDomain(DomainStart=neg, DomainEnd=division_28)
remap = RemapNumbers(Value=dist_2, Source=bnd, Target=dom_7)  # -> Mapped, Clipped

midpt_2 = CurveMiddle(Curve=ptstrimcrv.Trimmed)
midpt_3 = CurveMiddle(Curve=ln_8)
ptstrimcrv_3 = PointsTrimCurve(Curve=intcrv.Curve, Points=midpt_2, Flip=False)  # -> Trimmed, SubDomains, Intersected
ln_9 = Line(StartPoint=item_4, EndPoint=midpt_3)
divide_5 = DivideCurve(Curve=ln_9, Count="10", Kinks=False)  # -> Points, Tangents, Parameters
divide_6 = DivideCurve(Curve=ptstrimcrv_3.Trimmed, Count="10", Kinks=False)  # -> Points, Tangents, Parameters
dist_3 = Distance(PointA=divide_6.Points, PointB=divide_5.Points)
bnd_2 = Bounds(Numbers=dist_3)
remap_2 = RemapNumbers(Value=dist_3, Source=bnd_2, Target=dom_7)  # -> Mapped, Clipped

addition_3 = Addition(A=division_26, B="1")
mirror_7 = Mirror(Geometry=ln_7, Plane=xz_5)  # -> Geometry, Transform
loft_8 = Loft(
    Curves=[mirror_7.Geometry, ln_7],
    Options={Adjust=False, Closed=False, LoftEnds=0, LoftSimp=0, LoftType=0, Rebuild=10, Refit=0.01})
panel_20 = Panel(remap.Mapped)
Z_5 = UnitZ(Factor=expr("-X", remap_2.Mapped))
Z_6 = UnitZ(Factor=remap_2.Mapped)

round_10 = Round(Number=addition_3)  # -> Nearest, Floor, Ceiling
arrlinear = LinearArray(Geometry=ln_7, Direction=Z_4, Count=round_10.Nearest)  # -> flatten(Geometry), Transform
cull_i_3 = CullIndex(List=arrlinear.Geometry, Indices="0", Wrap=True)
crv_11 = Curve(cull_i_3)
dispatch = Dispatch(List=crv_11, DispatchPattern=[True, False])  # -> ListA, ListB
divide_7 = DivideCurve(Curve=dispatch.ListB, Count=round_9.Nearest, Kinks=False)  # -> Points, Tangents, Parameters
divide_8 = DivideCurve(Curve=dispatch.ListA, Count=round_9.Nearest, Kinks=False)  # -> Points, Tangents, Parameters

len_7 = Length(Curve=offset_3)
round_11 = Round(Number=division_24)  # -> Nearest, Floor, Ceiling
shapesolver_3 = ShapeSolver(Shape=brep_5, Method=1, Fineness=number_slider_8, Tolerance=0.001)  # -> Info, Code, SolveData
shapemap_3 = ShapeMap(SolveData=shapesolver_3.SolveData, Line0=line_4, Line1=line_5, Area=toggle_2)  # -> MapData, Border
evalsrf = EvaluateSurface(Surface=reparameterize(flatten(loft_7)), Point=md_slider_3)  # -> Point, Normal, UDirection, VDirection, Frame
crv_12 = Curve(shapemap_3.Border)
dispatch_2 = Dispatch(List=evalsrf.Normal, DispatchPattern=[True, False])  # -> ListA, ListB
bbox_2 = BoundingBox(Content=crv_12, Plane=PlaneXY(0, 0, 0))  # -> Box, Box_2
srf_3 = Surface(bbox_2.Box)
panel_21 = Panel(partition_3)
srf_4 = Surface(partition_3)
evalsrf_2 = EvaluateSurface(Surface=reparameterize(srf_4), Point=md_slider_4)  # -> Point, Normal, UDirection, VDirection, Frame
debrep = DeconstructBrep(Brep=srf_4)  # -> Faces, Edges, Vertices
item_17 = ListItem(List=debrep.Edges, Index=0, Wrap=True)  # -> Item, Item1, Item2, Item3
midpt_4 = CurveMiddle(Curve=item_17.Item3)
midpt_5 = CurveMiddle(Curve=item_17.Item1)
amp = Amplitude(Vector=dispatch_2.ListA, Amplitude=expr("x*2", block_width_5))

division_29 = Division(A=division, B="2")
division_30 = Division(A=len_5, B=py3_4.a)
subtraction_4 = Subtraction(A=division_30, B=amplitude_4)
Y_10 = UnitY(Factor=division_29)
X_19 = UnitX(Factor=vault_length_3)
move_31 = Move(Geometry=pt, Motion=Y_10)  # -> Geometry, Transform
move_32 = Move(Geometry=move_31.Geometry, Motion=X_19)  # -> Geometry, Transform
Z_7 = UnitZ(Factor=division_30)
ln_10 = Line(StartPoint=move_31.Geometry, EndPoint=move_32.Geometry)
panel_22 = Panel("""0
-1""")
division_31 = Division(A=vault_length_3, B=block_length_5)
round_12 = Round(Number=division_31)  # -> Nearest, Floor, Ceiling

end_8 = EndPoints(Curve=ptstrimcrv_2.Trimmed)  # -> Start, End
ln_11 = Line(StartPoint=end_8.Start, EndPoint=end_8.End)
Y_11 = UnitY(Factor="1")
move_33 = Move(Geometry=ln_11, Motion=Y_11)  # -> Geometry, Transform
divide_9 = DivideCurve(Curve=ptstrimcrv_2.Trimmed, Count="10", Kinks=False)  # -> Points, Tangents, Parameters
crv_cp_3 = CurveClosestPoint(Point=divide_9.Points, Curve=ln_11)  # -> Point, Parameter, Distance
dist_4 = Distance(PointA=divide_9.Points, PointB=crv_cp_3.Point)
bnd_3 = Bounds(Numbers=dist_4)

division_32 = Division(A=amplitude_4, B="2")
neg_2 = Negative(Value=division_32)
dom_8 = ConstructDomain(DomainStart=neg_2, DomainEnd=division_32)
remap_3 = RemapNumbers(Value=dist_4, Source=bnd_3, Target=dom_8)  # -> Mapped, Clipped

midpt_6 = CurveMiddle(Curve=ptstrimcrv_2.Trimmed)
midpt_7 = CurveMiddle(Curve=ln_11)
ptstrimcrv_4 = PointsTrimCurve(Curve=intcrv_2.Curve, Points=midpt_6, Flip=False)  # -> Trimmed, SubDomains, Intersected
ln_12 = Line(StartPoint=item_5, EndPoint=midpt_7)
divide_10 = DivideCurve(Curve=ln_12, Count="10", Kinks=False)  # -> Points, Tangents, Parameters
divide_11 = DivideCurve(Curve=ptstrimcrv_4.Trimmed, Count="10", Kinks=False)  # -> Points, Tangents, Parameters
dist_5 = Distance(PointA=divide_11.Points, PointB=divide_10.Points)
bnd_4 = Bounds(Numbers=dist_5)
remap_4 = RemapNumbers(Value=dist_5, Source=bnd_4, Target=dom_8)  # -> Mapped, Clipped

addition_4 = Addition(A=py3_4.a, B="1")
Y_12 = UnitY(Factor=expr("-x", division_29))
mirror_8 = Mirror(Geometry=ln_10, Plane=xz_3)  # -> Geometry, Transform
loft_9 = Loft(
    Curves=[mirror_8.Geometry, ln_10],
    Options={Adjust=False, Closed=False, LoftEnds=0, LoftSimp=0, LoftType=0, Rebuild=10, Refit=0.01})
multiplication_5 = Multiplication(A=round_12.Nearest, B="2")
divide_12 = DivideCurve(Curve=ln_2, Count=multiplication_5, Kinks=False)  # -> Points, Tangents, Parameters
panel_23 = Panel(remap_3.Mapped)
Z_8 = UnitZ(Factor=expr("-X", remap_4.Mapped))
Z_9 = UnitZ(Factor=remap_4.Mapped)

# ---- group: base wall curve
ln_13 = Line(StartPoint=pt, EndPoint=move_22.Geometry)
move_34 = Move(Geometry=ln_13, Motion=Y_12)  # -> Geometry, Transform

# ---- group: top surface
move_35 = Move(Geometry=loft_9, Motion=Z_2)  # -> Geometry, Transform
move_36 = Move(Geometry=mirror_8.Geometry, Motion=Z_2)  # -> Geometry, Transform
move_37 = Move(Geometry=ln_10, Motion=Z_2)  # -> Geometry, Transform

# ----
xz_7 = XZPlane(Origin=flatten(divide_12.Points))
panel_24 = Panel("""0
-1""")
planesrf_2 = PlaneSurface(Plane=xz_7, XSize=Domain(-4, 4), YSize=Domain(-2, 2))
cull_i_4 = CullIndex(List=planesrf_2, Indices=panel_24, Wrap=True)
dispatch_3 = Dispatch(List=cull_i_4, DispatchPattern=[True, False])  # -> ListA, ListB

xz_8 = XZPlane(Origin=flatten(divide_12.Points))  # disabled
panel_25 = Panel("""0
-1""")  # disabled
planesrf_3 = PlaneSurface(Plane=xz_8, XSize=Domain(-4, 4), YSize=Domain(-2, 2))  # disabled
cull_i_5 = CullIndex(List=planesrf_3, Indices=panel_25, Wrap=True)  # disabled
dispatch_4 = Dispatch(List=cull_i_5, DispatchPattern=[True, False])  # -> ListA, ListB; disabled

bang = ExplodeTree(Data=divide_8.Parameters)  # -> Branch0, Branch1, Branch2, Branch3
bang_2 = ExplodeTree(Data=divide_7.Parameters)  # -> Branch0, Branch1, Branch2, Branch3
panel_26 = Panel(divide_7.Parameters)

shatter_3 = Shatter(Curve=dispatch.ListA, Parameters=bang.Branch0)
shatter_4 = Shatter(Curve=dispatch.ListB, Parameters=bang_2.Branch0)
divide_13 = DivideCurve(Curve=shatter_4, Count="10", Kinks=False)  # -> Points, Tangents, Parameters
divide_14 = DivideCurve(Curve=shatter_3, Count="10", Kinks=False)  # -> Points, Tangents, Parameters

xz_9 = XZPlane(Origin=Point(0, 0, 0))
mirror_9 = Mirror(Geometry=shatter_3, Plane=xz_9)  # -> Geometry, Transform
mirror_10 = Mirror(Geometry=shatter_4, Plane=xz_9)  # -> Geometry, Transform
crv_13 = Curve(mirror_10.Geometry)
crv_14 = Curve(mirror_9.Geometry)
end_9 = EndPoints(Curve=crv_13)  # -> Start, End
end_10 = EndPoints(Curve=crv_14)  # -> Start, End

Z_10 = UnitZ(Factor=expr("-x", remap.Mapped))
Z_11 = UnitZ(Factor=remap.Mapped)
move_38 = Move(Geometry=divide_14.Points, Motion=Z_10)  # -> Geometry, Transform
move_39 = Move(Geometry=divide_13.Points, Motion=Z_11)  # -> Geometry, Transform

intcrv_7 = Interpolate(Vertices=move_38.Geometry, Degree=3, Periodic=False, KnotStyle=1)  # -> Curve, Length, Domain
intcrv_8 = Interpolate(Vertices=move_39.Geometry, Degree=3, Periodic=False, KnotStyle=1)  # -> Curve, Length, Domain

debrep_2 = DeconstructBrep(Brep=srf_2)  # -> Faces, Edges, Vertices
division_33 = Division(A=len_6, B=py3_5.a)
X_20 = UnitX(Factor=expr("-x", division_33))
item_18 = ListItem(List=debrep_2.Edges, Index=0, Wrap=True)  # -> Item, Item1
addition_5 = Addition(A=py3_5.a, B="1")
arrlinear_2 = LinearArray(Geometry=item_18.Item1, Direction=X_20, Count=addition_5)  # -> Geometry, Transform
panel_27 = Panel("""0
-1""")
cull_i_6 = CullIndex(List=arrlinear_2.Geometry, Indices=panel_27, Wrap=True)
item_19 = ListItem(List=arrlinear_2.Geometry, Index=0, Wrap=True)  # -> Item1, Item
multiplication_6 = Multiplication(A=round_11.Nearest, B="2")
dispatch_5 = Dispatch(List=cull_i_6, DispatchPattern=[True, False])  # -> ListA, ListB
divide_15 = DivideCurve(Curve=dispatch_5.ListB, Count=multiplication_6, Kinks=False)  # -> Points, Tangents, Parameters
divide_16 = DivideCurve(Curve=item_19.Item, Count=round_11.Nearest, Kinks=False)  # -> Points, Tangents, Parameters
divide_17 = DivideCurve(Curve=item_19.Item1, Count=round_11.Nearest, Kinks=False)  # -> Points, Tangents, Parameters
divide_18 = DivideCurve(Curve=dispatch_5.ListA, Count=multiplication_6, Kinks=False)  # -> Points, Tangents, Parameters
number_slider_9 = Slider(0.03, range=0.005..0.05)
dispatch_6 = Dispatch(List=divide_18.Points, DispatchPattern=[True, False])  # -> ListA, ListB
dispatch_7 = Dispatch(List=divide_15.Points, DispatchPattern=[True, False])  # -> ListA, ListB
pt_9 = Point(dispatch_6.ListB)
pt_10 = Point(dispatch_6.ListA)
pt_11 = Point(dispatch_7.ListB)
pt_12 = Point(dispatch_7.ListA)
X_21 = UnitX(Factor=expr("-x", number_slider_9))
X_22 = UnitX(Factor=number_slider_9)
move_40 = Move(Geometry=pt_9, Motion=X_22)  # -> Geometry, Transform
move_41 = Move(Geometry=pt_11, Motion=X_21)  # -> Geometry, Transform
weave_3 = Weave(Pattern=[0, 1], Stream0=pt_10, Stream1=move_40.Geometry, NullGaps=False)
weave_4 = Weave(Pattern=[0, 1], Stream0=pt_12, Stream1=move_41.Geometry, NullGaps=False)
X_23 = UnitX(Factor=expr("-x/2", number_slider_9))
X_24 = UnitX(Factor=expr("x/2", number_slider_9))
move_42 = Move(Geometry=weave_3, Motion=X_23)  # -> Geometry, Transform
move_43 = Move(Geometry=weave_4, Motion=X_24)  # -> Geometry, Transform
addition_6 = Addition(A=multiplication_6, B="1")
panel_28 = Panel("""0
-1""")

maptoshape_2 = MapToShape(MapData=shapemap_2.MapData, Geometry=flatten(divide_16.Points), Length=1, Pull=False)  # -> flatten(Geometry), Normal
maptoshape_3 = MapToShape(MapData=shapemap_2.MapData, Geometry=flatten(divide_17.Points), Length=1, Pull=False)  # -> flatten(Geometry), Normal
maptoshape_4 = MapToShape(MapData=shapemap_2.MapData, Geometry=flatten(move_42.Geometry), Length=1, Pull=False)  # -> flatten(Geometry), Normal
maptoshape_5 = MapToShape(MapData=shapemap_2.MapData, Geometry=flatten(move_43.Geometry), Length=1, Pull=False)  # -> flatten(Geometry), Normal

partition_4 = PartitionList(List=maptoshape_5.Geometry, Size=addition_6)
partition_5 = PartitionList(List=maptoshape_4.Geometry, Size=addition_6)
intcrv_9 = Interpolate(Vertices=maptoshape_3.Geometry, Degree=1, Periodic=False, KnotStyle=1)  # -> Curve, Length, Domain
intcrv_10 = Interpolate(Vertices=partition_4, Degree=1, Periodic=False, KnotStyle=1)  # -> Curve, Length, Domain
intcrv_11 = Interpolate(Vertices=maptoshape_2.Geometry, Degree=1, Periodic=False, KnotStyle=1)  # -> Curve, Length, Domain
intcrv_12 = Interpolate(Vertices=partition_5, Degree=1, Periodic=False, KnotStyle=1)  # -> Curve, Length, Domain
weave_5 = Weave(
    Pattern=[0, 1, 2],
    Stream0=flatten(intcrv_11.Curve),
    Stream1=flatten(intcrv_12.Curve),
    Stream2=flatten(intcrv_10.Curve),
    NullGaps=False)
merge = Merge(Data1=weave_5, Data2=intcrv_9.Curve)
cull_i_7 = CullIndex(List=merge, Indices=panel_28, Wrap=True)
partition_6 = PartitionList(List=merge, Size="2")
partition_7 = PartitionList(List=cull_i_7, Size="2")

loft_10 = Loft(Curves=partition_6, Options={Adjust=False, Closed=False, LoftEnds=0, LoftSimp=0, LoftType=0, Rebuild=10, Refit=0.01})
loft_11 = Loft(Curves=partition_7, Options={Adjust=False, Closed=False, LoftEnds=0, LoftSimp=0, LoftType=0, Rebuild=10, Refit=0.01})

debrep_3 = DeconstructBrep(Brep=srf_3)  # -> Faces, Edges, Vertices
item_20 = ListItem(List=debrep_3.Edges, Index=0, Wrap=True)  # -> Item, Item1
addition_7 = Addition(A=py3_5.a, B="1")
panel_29 = Panel("""0
-1""")
multiplication_7 = Multiplication(A=round_11.Nearest, B="2")
number_slider_10 = Slider(0.03, range=0.005..0.05)
X_25 = UnitX(Factor=expr("-x", number_slider_10))
X_26 = UnitX(Factor=number_slider_10)
X_27 = UnitX(Factor=expr("-x/2", number_slider_10))
X_28 = UnitX(Factor=expr("x/2", number_slider_10))
addition_8 = Addition(A=multiplication_7, B="1")
panel_30 = Panel("""0
-1""")

divide_19 = DivideCurve(Curve=item_20.Item, Count=py3_5.a, Kinks=False)  # -> Points, Tangents, Parameters
item_21 = ListItem(List=divide_19.Points, Index=0, Wrap=True)  # -> Item, Item1
dist_6 = Distance(PointA=item_21.Item, PointB=item_21.Item1)

bbox_3 = BoundingBox(Content=crv_8, Plane=PlaneXY(0, 0, 0))  # -> Box, Box_2
srf_5 = Surface(bbox_3.Box)

debrep_4 = DeconstructBrep(Brep=srf_5)  # -> Faces, Edges, Vertices
item_22 = ListItem(List=debrep_4.Edges, Index=0, Wrap=True)  # -> Item, Item1
divide_20 = DivideCurve(Curve=item_22.Item, Count=round_4.Ceiling, Kinks=False)  # -> Points, Tangents, Parameters
end_11 = EndPoints(Curve=item_22.Item1)  # -> Start, End
move2pt = MoveToPoint(Geometry=item_22.Item1, PointA=end_11.Start, PointB=divide_20.Points)  # -> flatten(Moved), Vector, Transform
multiplication_8 = Multiplication(A=round_5.Ceiling, B="2")
divide_21 = DivideCurve(Curve=move2pt.Moved, Count=multiplication_8, Kinks=False)  # -> Points, Tangents, Parameters
item_23 = ListItem(List=divide_21.Points, Index=0, Wrap=True)  # -> Item3, Item2, Item1, Item, Item1_2, Item2_2
vec2pt = Vector2Pt(PointA=item_23.Item1_2, PointB=item_23.Item, Unitize=False)  # -> Vector, Length
vec2pt_2 = Vector2Pt(PointA=item_23.Item2, PointB=item_23.Item1, Unitize=False)  # -> Vector, Length
move_44 = Move(Geometry=item_23.Item1, Motion=vec2pt_2.Vector)  # -> Geometry, Transform
move_45 = Move(Geometry=item_23.Item, Motion=vec2pt.Vector)  # -> Geometry, Transform
merge_2 = Merge(Data1=move_45.Geometry, Data2=divide_21.Points, Data3=move_44.Geometry)
tstat = TreeStatistics(Tree=merge_2)  # -> Paths, Length, Count
panel_31 = Panel("""0
-1""")
cull_i_8 = CullIndex(List=tstat.Paths, Indices=panel_31, Wrap=True)
branch = TreeBranch(Tree=merge_2, Path=cull_i_8, MaintainPaths=True)

# ---- group: Boundary curve
crv_15 = Curve(srf_5)

# ----
quadstag_2 = StaggeredQuadPanels(Surface=crv_15, UDivisions=Slider(20, range=0..100), VDivisions=Slider(40, range=0..100))
maptoshape_6 = MapToShape(MapData=shapemap.MapData, Geometry=quadstag_2, Length=1, Pull=False)  # -> Geometry, Normal

# ---- group: Point Grid
pt_13 = Point(simplify(branch))

# ----
split_6 = SplitTree(Data=pt_13, Masks=flatten("{0,2,...}"))  # -> Positive, Negative

number_slider_11 = Slider(0.02, range=0..0.1)
pt_14 = Point(split_6.Negative)
dispatch_8 = Dispatch(List=pt_14, DispatchPattern=[True, False])  # -> ListA, ListB
X_29 = UnitX(Factor=expr("-x", number_slider_11))
pt_15 = Point(dispatch_8.ListB)
pt_16 = Point(dispatch_8.ListA)
move_46 = Move(Geometry=pt_15, Motion=X_29)  # -> Geometry, Transform
division_34 = Division(A=number_slider_11, B="2")
vec2pt_3 = Vector2Pt(PointA=move_46.Geometry, PointB=pt_15, Unitize=False)  # -> Vector, Length
weave_6 = Weave(Pattern=[0, 1], Stream0=pt_16, Stream1=move_46.Geometry, NullGaps=False)
amp_2 = Amplitude(Vector=vec2pt_3.Vector, Amplitude=division_34)
move_47 = Move(Geometry=weave_6, Motion=amp_2)  # -> Geometry, Transform
intcrv_13 = Interpolate(Vertices=move_47.Geometry, Degree=3, Periodic=False, KnotStyle=1)  # -> Curve, Length, Domain

pt_17 = Point(split_6.Positive)
dispatch_9 = Dispatch(List=pt_17, DispatchPattern=[True, False])  # -> ListA, ListB
pt_18 = Point(dispatch_9.ListB)
X_30 = UnitX(Factor=number_slider_11)
pt_19 = Point(dispatch_9.ListA)
move_48 = Move(Geometry=pt_18, Motion=X_30)  # -> Geometry, Transform
division_35 = Division(A=number_slider_11, B="2")
vec2pt_4 = Vector2Pt(PointA=move_48.Geometry, PointB=pt_18, Unitize=False)  # -> Vector, Length
weave_7 = Weave(Pattern=[0, 1], Stream0=pt_19, Stream1=move_48.Geometry, NullGaps=False)
amp_3 = Amplitude(Vector=vec2pt_4.Vector, Amplitude=division_35)
move_49 = Move(Geometry=weave_7, Motion=amp_3)  # -> Geometry, Transform
intcrv_14 = Interpolate(Vertices=move_49.Geometry, Degree=3, Periodic=False, KnotStyle=1)  # -> Curve, Length, Domain

pt_20 = Point(move_47.Geometry)
pt_21 = Point(move_49.Geometry)
panel_32 = Panel("""0
-1""")
cull_i_9 = CullIndex(List=pt_20, Indices=panel_32, Wrap=True)
cull_i_10 = CullIndex(List=pt_21, Indices=panel_32, Wrap=True)
lng = ListLength(List=cull_i_9)
maptoshape_7 = MapToShape(MapData=shapemap.MapData, Geometry=flatten(cull_i_9), Length=1, Pull=False)  # -> flatten(Geometry), Normal
maptoshape_8 = MapToShape(MapData=shapemap.MapData, Geometry=flatten(cull_i_10), Length=1, Pull=False)  # -> Geometry, Normal
lng_2 = ListLength(List=cull_i_10)
item_24 = ListItem(List=flatten(lng), Index=0, Wrap=True)
item_25 = ListItem(List=flatten(lng_2), Index=0, Wrap=True)
partition_8 = PartitionList(List=maptoshape_7.Geometry, Size=item_24)
partition_9 = PartitionList(List=maptoshape_8.Geometry, Size=item_25)
intcrv_15 = Interpolate(Vertices=partition_9, Degree=3, Periodic=False, KnotStyle=1)  # -> Curve, Length, Domain
merge_3 = Merge(Data1=flatten(ln_6), Data2=flatten(intcrv_15.Curve))
intcrv_16 = Interpolate(Vertices=partition_8, Degree=3, Periodic=False, KnotStyle=1)  # -> Curve, Length, Domain
merge_4 = Merge(Data1=flatten(intcrv_16.Curve), Data2=flatten(ln_5))
dispatch_10 = Dispatch(List=partition_8, DispatchPattern=[True, False])  # -> ListA, ListB
dispatch_11 = Dispatch(List=partition_9, DispatchPattern=[True, False])  # -> ListA, ListB

weave_8 = Weave(Pattern=[0, 1], Stream0=merge_3, Stream1=merge_4, NullGaps=False)
pt_22 = Point(partition_9)
pln = Plane(intcrv_15.Curve)
panel_33 = Panel("""2
2
2""")
partition_10 = PartitionList(List=weave_8, Size=panel_33)
item_26 = ListItem(List=pt_22, Index=0, Wrap=True)  # -> Item2, Item1, Item, Item1_2
amp_4 = Amplitude(Vector=pln, Amplitude=number_slider_2)
loft_12 = Loft(Curves=partition_10, Options={Adjust=False, Closed=False, LoftEnds=0, LoftSimp=0, LoftType=2, Rebuild=10, Refit=0.01})
ln_14 = Line(StartPoint=item_26.Item, EndPoint=item_26.Item1_2)
ln_15 = Line(StartPoint=item_26.Item2, EndPoint=item_26.Item1)
angle_2 = Slider(180, range=0..180)
srf_6 = Surface(loft_12)
midpt_8 = CurveMiddle(Curve=ln_14)
midpt_9 = CurveMiddle(Curve=ln_15)
ln_16 = Line(StartPoint=midpt_9, EndPoint=midpt_8)
end_12 = EndPoints(Curve=ln_16)  # -> Start, End
multiplication_9 = Multiplication(A=angle_2, B="0.0174533")
xz_10 = XZPlane(Origin=end_12.Start)
rotate_2 = Rotate(Geometry=intcrv_15.Curve, Angle=multiplication_9, Plane=xz_10)  # -> Geometry, Transform
move_50 = Move(Geometry=rotate_2.Geometry, Motion=amp_4)  # -> Geometry, Transform
weave_9 = Weave(Pattern=[0, 1], Stream0=intcrv_15.Curve, Stream1=move_50.Geometry, NullGaps=False)
loft_13 = Loft(Curves=weave_9, Options={Adjust=False, Closed=False, LoftEnds=0, LoftSimp=0, LoftType=0, Rebuild=10, Refit=0.01})

weave_10 = Weave(Pattern=[0, 1], Stream0=intcrv_16.Curve, Stream1=intcrv_15.Curve, NullGaps=False)
pt_23 = Point(partition_8)
pln_2 = Plane(intcrv_16.Curve)
loft_14 = Loft(Curves=weave_10, Options={Adjust=False, Closed=False, LoftEnds=0, LoftSimp=0, LoftType=2, Rebuild=10, Refit=0.01})
item_27 = ListItem(List=pt_23, Index=0, Wrap=True)  # -> Item2, Item1, Item, Item1_2
amp_5 = Amplitude(Vector=pln_2, Amplitude=expr("-x", number_slider_2))
cull_i_11 = CullIndex(List=flatten(loft_14), Indices="-1", Wrap=True)
ln_17 = Line(StartPoint=item_27.Item, EndPoint=item_27.Item1_2)
ln_18 = Line(StartPoint=item_27.Item2, EndPoint=item_27.Item1)
angle_3 = Slider(180, range=0..180)
srf_7 = Surface(loft_14)
midpt_10 = CurveMiddle(Curve=ln_17)
midpt_11 = CurveMiddle(Curve=ln_18)
ln_19 = Line(StartPoint=midpt_11, EndPoint=midpt_10)
end_13 = EndPoints(Curve=ln_19)  # -> Start, End
multiplication_10 = Multiplication(A=angle_3, B="0.0174533")
xz_11 = XZPlane(Origin=end_13.Start)
rotate_3 = Rotate(Geometry=intcrv_16.Curve, Angle=multiplication_10, Plane=xz_11)  # -> Geometry, Transform
move_51 = Move(Geometry=rotate_3.Geometry, Motion=amp_5)  # -> Geometry, Transform
weave_11 = Weave(Pattern=[0, 1], Stream0=intcrv_16.Curve, Stream1=move_51.Geometry, NullGaps=False)
loft_15 = Loft(Curves=weave_11, Options={Adjust=False, Closed=False, LoftEnds=0, LoftSimp=0, LoftType=0, Rebuild=10, Refit=0.01})

pt_24 = Point(dispatch_11.ListB)
pt_25 = Point(dispatch_10.ListB)
graft = GraftTree(Tree=pt_24, IncludeEmptyLists=True, IncludeNullItems=True)
tstat_2 = TreeStatistics(Tree=pt_25)  # -> Paths, Length, Count
cull_i_12 = CullIndex(List=tstat_2.Paths, Indices="-1", Wrap=True)
branch_2 = TreeBranch(Tree=pt_25, Path=cull_i_12, MaintainPaths=True)
graft_2 = GraftTree(Tree=branch_2, IncludeEmptyLists=True, IncludeNullItems=True)
weave_12 = Weave(Pattern=[0, 1], Stream0=graft_2, Stream1=graft, NullGaps=False)
item_28 = ListItem(List=weave_12, Index=0, Wrap=True)  # -> Item, Item1
ln_20 = Line(StartPoint=item_28.Item1, EndPoint=item_28.Item)

merge_5 = Merge(Data1=flatten(loft_3), Data2=flatten(loft_13))
merge_6 = Merge(Data1=flatten(loft_15), Data2=flatten(loft_2))
merge_7 = Merge(Data1=flatten(move_51.Geometry), Data2=flatten(move_50.Geometry))
weave_13 = Weave(Pattern=[0, 1], Stream0=flatten(move_51.Geometry), Stream1=flatten(move_50.Geometry), NullGaps=False)
weave_14 = Weave(Pattern=[0, 1], Stream0=move_51.Geometry, Stream1=move_50.Geometry, NullGaps=False)
merge_8 = Merge(Data1=move_21.Geometry, Data2=weave_13, Data3=move_20.Geometry)
panel_34 = Panel("""2
2
2""")
item_29 = ListItem(List=merge_8, Index=0, Wrap=True)  # -> Item, Item1, Item2, Item3, Item4
partition_11 = PartitionList(List=merge_8, Size=panel_34)
loft_16 = Loft(Curves=partition_11, Options={Adjust=False, Closed=False, LoftEnds=0, LoftSimp=0, LoftType=0, Rebuild=10, Refit=0.01})  # -> flatten(Loft)
loft_17 = Loft(Curves=weave_14, Options={Adjust=False, Closed=False, LoftEnds=0, LoftSimp=0, LoftType=0, Rebuild=10, Refit=0.01})  # -> flatten(Loft)
weave_15 = Weave(Pattern=[0, 1], Stream0=flatten(srf_6), Stream1=flatten(srf_7), NullGaps=False)
weave_16 = Weave(Pattern=[0, 1], Stream0=loft_16, Stream1=loft_17, NullGaps=False)
weave_17 = Weave(Pattern=[0, 1], Stream0=merge_5, Stream1=merge_6, NullGaps=False)
cull_i_13 = CullIndex(List=weave_17, Indices="0", Wrap=True)
cull_i_14 = CullIndex(List=weave_17, Indices="-1", Wrap=True)
weave_18 = Weave(
    Pattern=[0, 1, 2, 3],
    Stream0=graft(cull_i_14),
    Stream1=graft(weave_15),
    Stream2=graft(cull_i_13),
    Stream3=graft(weave_16),
    NullGaps=False)
join_2 = BrepJoin(Breps=weave_18)  # -> flatten(Breps), Closed

pt_26 = Point(partition_8)
branch_3 = TreeBranch(Tree=pt_26, Path="{0;0}", MaintainPaths=True)
xz_12 = XZPlane(Origin=branch_3)
dispatch_12 = Dispatch(List=join_2.Breps, DispatchPattern=[True, False])  # -> ListA, ListB
dispatch_13 = Dispatch(List=xz_12, DispatchPattern=[True, False])  # -> flatten(ListA), flatten(ListB)
brep_7 = Brep(dispatch_12.ListA)
brep_8 = Brep(dispatch_12.ListB)
planesrf_4 = PlaneSurface(Plane=dispatch_13.ListA, XSize=Domain(-10, 10), YSize=Domain(-10, 10))
planesrf_5 = PlaneSurface(Plane=dispatch_13.ListB, XSize=Domain(-10, 10), YSize=Domain(-10, 10))
splitmul = SplitBrepMultiple(Brep=flatten(brep_7), Cutters=flatten(planesrf_4))
splitmul_2 = SplitBrepMultiple(Brep=brep_8, Cutters=planesrf_5)

round_13 = Round(Number=addition_4)  # -> Nearest, Floor, Ceiling
arrlinear_3 = LinearArray(Geometry=ln_10, Direction=Z_7, Count=addition_4)  # -> flatten(Geometry), Transform
cull_i_15 = CullIndex(List=arrlinear_3.Geometry, Indices=panel_22, Wrap=True)
crv_16 = Curve(cull_i_15)
dispatch_14 = Dispatch(List=crv_16, DispatchPattern=[True, False])  # -> ListA, ListB
divide_22 = DivideCurve(Curve=dispatch_14.ListB, Count=round_12.Nearest, Kinks=False)  # -> Points, Tangents, Parameters
divide_23 = DivideCurve(Curve=dispatch_14.ListA, Count=round_12.Nearest, Kinks=False)  # -> Points, Tangents, Parameters

X_31 = UnitX(Factor=expr("-x", dist_6))
arrlinear_4 = LinearArray(Geometry=item_20.Item1, Direction=X_31, Count=addition_7)  # -> Geometry, Transform
cull_i_16 = CullIndex(List=arrlinear_4.Geometry, Indices=panel_29, Wrap=True)
item_30 = ListItem(List=arrlinear_4.Geometry, Index=0, Wrap=True)  # -> Item1, Item
dispatch_15 = Dispatch(List=cull_i_16, DispatchPattern=[True, False])  # -> ListA, ListB
divide_24 = DivideCurve(Curve=dispatch_15.ListB, Count=multiplication_7, Kinks=False)  # -> Points, Tangents, Parameters
divide_25 = DivideCurve(Curve=item_30.Item, Count=round_11.Nearest, Kinks=False)  # -> Points, Tangents, Parameters
divide_26 = DivideCurve(Curve=item_30.Item1, Count=round_11.Nearest, Kinks=False)  # -> Points, Tangents, Parameters
divide_27 = DivideCurve(Curve=dispatch_15.ListA, Count=multiplication_7, Kinks=False)  # -> Points, Tangents, Parameters
dispatch_16 = Dispatch(List=divide_27.Points, DispatchPattern=[True, False])  # -> ListA, ListB
dispatch_17 = Dispatch(List=divide_24.Points, DispatchPattern=[True, False])  # -> ListA, ListB
pt_27 = Point(dispatch_16.ListB)
pt_28 = Point(dispatch_17.ListB)
pt_29 = Point(dispatch_16.ListA)
pt_30 = Point(dispatch_17.ListA)
move_52 = Move(Geometry=pt_27, Motion=X_26)  # -> Geometry, Transform
move_53 = Move(Geometry=pt_28, Motion=X_25)  # -> Geometry, Transform
weave_19 = Weave(Pattern=[0, 1], Stream0=pt_29, Stream1=move_52.Geometry, NullGaps=False)
weave_20 = Weave(Pattern=[0, 1], Stream0=pt_30, Stream1=move_53.Geometry, NullGaps=False)
move_54 = Move(Geometry=weave_19, Motion=X_27)  # -> Geometry, Transform
move_55 = Move(Geometry=weave_20, Motion=X_28)  # -> Geometry, Transform

maptoshape_9 = MapToShape(MapData=shapemap_3.MapData, Geometry=flatten(divide_25.Points), Length=1, Pull=False)  # -> flatten(Geometry), Normal
maptoshape_10 = MapToShape(MapData=shapemap_3.MapData, Geometry=flatten(divide_26.Points), Length=1, Pull=False)  # -> flatten(Geometry), Normal
maptoshape_11 = MapToShape(MapData=shapemap_3.MapData, Geometry=flatten(move_54.Geometry), Length=1, Pull=False)  # -> flatten(Geometry), Normal
maptoshape_12 = MapToShape(MapData=shapemap_3.MapData, Geometry=flatten(move_55.Geometry), Length=1, Pull=False)  # -> flatten(Geometry), Normal

partition_12 = PartitionList(List=maptoshape_12.Geometry, Size=addition_8)
partition_13 = PartitionList(List=maptoshape_11.Geometry, Size=addition_8)
intcrv_17 = Interpolate(Vertices=maptoshape_10.Geometry, Degree=1, Periodic=False, KnotStyle=1)  # -> Curve, Length, Domain
intcrv_18 = Interpolate(Vertices=partition_12, Degree=1, Periodic=False, KnotStyle=1)  # -> Curve, Length, Domain
intcrv_19 = Interpolate(Vertices=maptoshape_9.Geometry, Degree=1, Periodic=False, KnotStyle=1)  # -> Curve, Length, Domain
intcrv_20 = Interpolate(Vertices=partition_13, Degree=1, Periodic=False, KnotStyle=1)  # -> Curve, Length, Domain
weave_21 = Weave(
    Pattern=[0, 1, 2],
    Stream0=flatten(intcrv_19.Curve),
    Stream1=flatten(intcrv_20.Curve),
    Stream2=flatten(intcrv_18.Curve),
    NullGaps=False)
merge_9 = Merge(Data1=weave_21, Data2=intcrv_17.Curve)
cull_i_17 = CullIndex(List=merge_9, Indices=panel_30, Wrap=True)
partition_14 = PartitionList(List=merge_9, Size="2")
partition_15 = PartitionList(List=cull_i_17, Size="2")

loft_18 = Loft(Curves=partition_14, Options={Adjust=False, Closed=False, LoftEnds=0, LoftSimp=0, LoftType=0, Rebuild=10, Refit=0.01})
loft_19 = Loft(Curves=partition_15, Options={Adjust=False, Closed=False, LoftEnds=0, LoftSimp=0, LoftType=0, Rebuild=10, Refit=0.01})

end_14 = EndPoints(Curve=shatter_4)  # -> Start, End
panel_35 = Panel(end_14.Start)
end_15 = EndPoints(Curve=shatter_3)  # -> Start, End
branch_4 = TreeBranch(Tree=end_14.Start, Path="{0;0;0}", MaintainPaths=True)
branch_5 = TreeBranch(Tree=shatter_4, Path="{0;0;0}", MaintainPaths=True)
midpt_12 = CurveMiddle(Curve=branch_5)
trim = TrimTree(Tree=intcrv_8.Curve, Depth=1)
trim_2 = TrimTree(Tree=intcrv_7.Curve, Depth=1)
mirror_11 = Mirror(Geometry=trim_2, Plane=xz_6)  # -> Geometry, Transform
mirror_12 = Mirror(Geometry=trim, Plane=xz_6)  # -> Geometry, Transform
end_16 = EndPoints(Curve=shatter_4)  # -> Start, End
end_17 = EndPoints(Curve=shatter_3)  # -> Start, End
xy_6 = XYPlane(Origin=end_16.Start)
xy_7 = XYPlane(Origin=end_17.Start)
yz_3 = YZPlane(Origin=branch_4)
yz_4 = YZPlane(Origin=midpt_12)
planesrf_6 = PlaneSurface(Plane=yz_3, XSize=Domain(-2, 2), YSize=Domain(-2, 2))
planesrf_7 = PlaneSurface(Plane=yz_4, XSize=Domain(-2, 2), YSize=Domain(-2, 2))

ln_21 = Line(StartPoint=end_9.Start, EndPoint=end_14.Start)
ln_22 = Line(StartPoint=end_10.Start, EndPoint=end_15.Start)

mirror_13 = Mirror(Geometry=mirror_11.Geometry, Plane=xy_7)  # -> Geometry, Transform
mirror_14 = Mirror(Geometry=mirror_12.Geometry, Plane=xy_6)  # -> Geometry, Transform

crv_17 = Curve(move_34.Geometry)
bang_3 = ExplodeTree(Data=divide_23.Parameters)  # -> Branch0, Branch1, Branch2, Branch3
bang_4 = ExplodeTree(Data=divide_22.Parameters)  # -> Branch0, Branch1, Branch2, Branch3
panel_36 = Panel(divide_22.Parameters)
crv_18 = Curve(move_37.Geometry)
crv_19 = Curve(move_36.Geometry)

shatter_5 = Shatter(Curve=dispatch_14.ListA, Parameters=bang_3.Branch0)
shatter_6 = Shatter(Curve=dispatch_14.ListB, Parameters=bang_4.Branch0)
divide_28 = DivideCurve(Curve=shatter_6, Count="10", Kinks=False)  # -> Points, Tangents, Parameters
divide_29 = DivideCurve(Curve=shatter_5, Count="10", Kinks=False)  # -> Points, Tangents, Parameters

xz_13 = XZPlane(Origin=Point(0, 0, 0))
mirror_15 = Mirror(Geometry=shatter_5, Plane=xz_13)  # -> Geometry, Transform
mirror_16 = Mirror(Geometry=shatter_6, Plane=xz_13)  # -> Geometry, Transform
crv_20 = Curve(mirror_15.Geometry)
crv_21 = Curve(mirror_16.Geometry)
end_18 = EndPoints(Curve=crv_21)  # -> Start, End
end_19 = EndPoints(Curve=crv_20)  # -> Start, End

Z_12 = UnitZ(Factor=expr("-x", remap_3.Mapped))
Z_13 = UnitZ(Factor=remap_3.Mapped)
move_56 = Move(Geometry=divide_29.Points, Motion=Z_12)  # -> Geometry, Transform
move_57 = Move(Geometry=divide_28.Points, Motion=Z_13)  # -> Geometry, Transform

intcrv_21 = Interpolate(Vertices=move_56.Geometry, Degree=3, Periodic=False, KnotStyle=1)  # -> Curve, Length, Domain
intcrv_22 = Interpolate(Vertices=move_57.Geometry, Degree=3, Periodic=False, KnotStyle=1)  # -> Curve, Length, Domain

explode_4 = Explode(Curve=maptoshape_6.Geometry, Recursive=True)  # -> Segments, Vertices
item_31 = ListItem(List=explode_4.Segments, Index=0, Wrap=True)  # -> Item, Item1, Item2, Item3
crv_22 = Curve([item_31.Item3, item_31.Item1])
midpt_13 = CurveMiddle(Curve=item_31.Item1)
dispatch_18 = Dispatch(List=move_47.Geometry, DispatchPattern=[True, False])  # -> ListA, ListB
dispatch_19 = Dispatch(List=move_49.Geometry, DispatchPattern=[True, False])  # -> ListA, ListB
evalsrf_3 = EvaluateSurface(Surface=reparameterize(srf_7), Point=md_slider)  # -> Point, Normal, UDirection, VDirection, Frame
evalsrf_4 = EvaluateSurface(Surface=reparameterize(srf_6), Point=md_slider_2)  # -> Point, Normal, UDirection, VDirection, Frame
cap = CapHoles(Brep=brep_7)
cap_2 = CapHoles(Brep=brep_8)
panel_37 = Panel(planesrf_4)
merge_10 = Merge(Data1=splitmul, Data2=splitmul_2)
area = Area(Geometry=merge_10)  # -> Area, Centroid
scale = Scale(Geometry=merge_10, Center=area.Centroid, Factor=Slider(0.98, range=0.9..1))  # -> Geometry, Transform
brep_9 = Brep(flatten(scale.Geometry))
lng_3 = ListLength(List=scale.Geometry)
debrep_5 = DeconstructBrep(Brep=scale.Geometry)  # -> Faces, Edges, Vertices
lng_4 = ListLength(List=flatten(lng_3))
lng_5 = ListLength(List=brep_9)
item_32 = ListItem(List=debrep_5.Vertices, Index=0, Wrap=True)  # -> Item, Item1, Item2, Item3
char_sequence = CharSequence(Count=lng_4, CharPool="ABCDEFGHIJKLMNOPQRSTUVWXYZ", Format="{0}")
panel_38 = Panel(scale.Geometry)
series_3 = Series(Start=number_slider_5, Step=number_slider_5, Count=lng_5)
weave_22 = Weave(Pattern=[0, 1, 2], Stream0=item_32.Item, Stream1=item_32.Item1, Stream2=item_32.Item2, NullGaps=False)
srf4pt_2 = _4PointSurface(CornerA=item_32.Item, CornerB=item_32.Item1, CornerC=item_32.Item2, CornerD=item_32.Item3)
concatenate = Concatenate(FragmentA=char_sequence, FragmentB=series_3)
panel_39 = Panel(srf4pt_2)
concatenate_2 = Concatenate(FragmentA=graft(concatenate), FragmentB=panel_15)  # -> flatten(Result)
panel_40 = Panel(concatenate)
brep_10 = Brep(flatten(merge_10))
panel_41 = Panel(concatenate_2)

pt_31 = Point(dispatch_19.ListB)
pt_32 = Point(dispatch_18.ListB)
graft_3 = GraftTree(Tree=pt_31, IncludeEmptyLists=True, IncludeNullItems=True)
tstat_3 = TreeStatistics(Tree=pt_32)  # -> Paths, Length, Count
cull_i_18 = CullIndex(List=tstat_3.Paths, Indices="-1", Wrap=True)
branch_6 = TreeBranch(Tree=pt_32, Path=cull_i_18, MaintainPaths=True)
graft_4 = GraftTree(Tree=branch_6, IncludeEmptyLists=True, IncludeNullItems=True)
weave_23 = Weave(Pattern=[0, 1], Stream0=graft_4, Stream1=graft_3, NullGaps=False)
item_33 = ListItem(List=weave_23, Index=0, Wrap=True)  # -> Item, Item1
ln_23 = Line(StartPoint=item_33.Item1, EndPoint=item_33.Item)

# ---- group: ORIENT PANELS ON PLANE SURFACE
md_slider_5 = MDSlider(SliderMode=0, slider_value=Point(0.5, 0.5, 0.5), x_domain=Domain(0, 1), y_domain=Domain(0, 1), z_domain=Domain(0, 1))
evaluate_surface = EvaluateSurface(Surface=reparameterize(flatten(srf4pt_2)), Point=md_slider_5)  # -> Point, Normal, UDirection, VDirection, Frame
rectangular = Rectangular(Plane=PlaneXY(0, 0, 0), SizeX=number_slider_4, SizeY=number_slider_4, ExtentX=number_slider_3, ExtentY=number_slider_3)  # -> Cells, flatten(Points)
orient = Orient(Geometry=flatten(scale.Geometry), Source=evaluate_surface.Frame, Target=rectangular.Points)  # -> Geometry, Transform

# ----
area_2 = Area(Geometry=brep_10)  # -> Area, Centroid
debrep_6 = DeconstructBrep(Brep=brep_10)  # -> Faces, Edges, Vertices
item_34 = ListItem(List=debrep_6.Faces, Index=0, Wrap=True)  # -> Item, Item1
edges_2 = BrepEdges(Brep=item_34.Item1)  # -> Naked, Interior, NonManifold
area_3 = Area(Geometry=item_34.Item1)  # -> flatten(Area), Centroid
join_3 = JoinCurves(Curves=edges_2.Naked, Preserve=False)  # -> flatten(Curves)
len_8 = Length(Curve=join_3)
entwine = Entwine(Branch00=area_2.Area, Branch01=area_3.Area, Branch02=len_8, FlattenInputs=True)

area_4 = Area(Geometry=orient.Geometry)  # -> Area, Centroid
text_tag_3d = TextTag3D(
    Location=area_4.Centroid,
    Text=concatenate,
    Size=Slider(0.1, range=0.1..0.9),
    Colour=ColourSwatch(SwatchColor=RGB(255, 0, 0)),
    Justification=7)
panel_42 = Panel(area_2.Area)
item_35 = ListItem(List=debrep_6.Faces, Index=0, Wrap=True)  # -> Item, Item1, Item2, Item3
area_5 = Area(Geometry=item_35.Item3)  # -> flatten(Area), Centroid
edges_3 = BrepEdges(Brep=item_35.Item3)  # -> Naked, Interior, NonManifold
item_36 = ListItem(List=edges_3.Naked, Index=0, Wrap=True)
crv_23 = Curve(item_36)
flip = FlipMatrix(Data=entwine)
len_9 = Length(Curve=crv_23)  # -> flatten(Length)
entwine_2 = Entwine(Branch00=area_5.Area, FlattenInputs=True)
flip_2 = FlipMatrix(Data=entwine_2)
gaussianmix = GaussianMixture(TrainingInputs=flip, Components=Slider(8, range=0..10), RandomSeed=5)  # -> Result, Likelihood, Probability
panel_43 = Panel(area_5.Area)
gaussianmix_2 = GaussianMixture(TrainingInputs=flip_2, Components=number_slider_7, RandomSeed=5)  # -> Result, Likelihood, Probability
k_means = KMeansClustering(TrainingInputs=flip_2, OfClusters=number_slider_7, RandomSeed=Slider(7, range=0..50))  # -> Result, Likelihood, Centroids
panel_44 = Panel(gaussianmix.Result)
bnd_5 = Bounds(Numbers=gaussianmix.Result)
dedomain = DeconstructDomain(Domain=bnd_5)  # -> Start, End
bnd_6 = Bounds(Numbers=k_means.Result)
bnd_7 = Bounds(Numbers=gaussianmix_2.Result)
dedomain_2 = DeconstructDomain(Domain=bnd_6)  # -> Start, End
dedomain_3 = DeconstructDomain(Domain=bnd_7)  # -> Start, End
gradient = Gradient(
    LowerLimit=dedomain.Start,
    UpperLimit=dedomain.End,
    Parameter=gaussianmix.Result,
    stops=[0: RGB(234, 38, 0), 0.25: RGB(234, 126, 0), 0.531: RGB(254, 244, 84), 0.75: RGB(173, 203, 249), 1: RGB(75, 107, 169)])
gradient_2 = Gradient(
    LowerLimit=dedomain_2.Start,
    UpperLimit=dedomain_2.End,
    Parameter=k_means.Result,
    stops=[0: RGB(234, 38, 0), 0.25: RGB(234, 126, 0), 0.547: RGB(254, 244, 84), 0.75: RGB(173, 203, 249), 1: RGB(75, 107, 169)])
gradient_3 = Gradient(
    LowerLimit=dedomain_3.Start,
    UpperLimit=dedomain_3.End,
    Parameter=gaussianmix_2.Result,
    stops=[0: RGB(234, 38, 0), 0.25: RGB(234, 126, 0), 0.547: RGB(254, 244, 84), 0.75: RGB(173, 203, 249), 1: RGB(75, 107, 169)])
preview = CustomPreview(Geometry=brep_10, Material=gradient)
preview_2 = CustomPreview(Geometry=brep_10, Material=gradient_2)
preview_3 = CustomPreview(Geometry=brep_10, Material=gradient_3)

end_20 = EndPoints(Curve=shatter_6)  # -> Start, End
panel_45 = Panel(end_20.Start)
end_21 = EndPoints(Curve=shatter_5)  # -> Start, End
branch_7 = TreeBranch(Tree=end_20.Start, Path="{0;0;0}", MaintainPaths=True)
branch_8 = TreeBranch(Tree=shatter_6, Path="{0;0;0}", MaintainPaths=True)
midpt_14 = CurveMiddle(Curve=branch_8)
trim_3 = TrimTree(Tree=intcrv_22.Curve, Depth=1)
trim_4 = TrimTree(Tree=intcrv_21.Curve, Depth=1)
mirror_17 = Mirror(Geometry=trim_4, Plane=xz_4)  # -> Geometry, Transform
mirror_18 = Mirror(Geometry=trim_3, Plane=xz_4)  # -> Geometry, Transform
end_22 = EndPoints(Curve=shatter_6)  # -> Start, End
end_23 = EndPoints(Curve=shatter_5)  # -> Start, End
xy_8 = XYPlane(Origin=end_22.Start)
xy_9 = XYPlane(Origin=end_23.Start)

ln_24 = Line(StartPoint=end_18.Start, EndPoint=end_20.Start)
ln_25 = Line(StartPoint=end_19.Start, EndPoint=end_21.Start)

mirror_19 = Mirror(Geometry=mirror_17.Geometry, Plane=xy_9)  # -> Geometry, Transform
mirror_20 = Mirror(Geometry=mirror_18.Geometry, Plane=xy_8)  # -> Geometry, Transform

divide_30 = DivideCurve(Curve=ln_21, Count="10", Kinks=False)  # -> Points, Tangents, Parameters
divide_31 = DivideCurve(Curve=ln_22, Count="10", Kinks=False)  # -> Points, Tangents, Parameters
move_58 = Move(Geometry=divide_30.Points, Motion=Z_5)  # -> Geometry, Transform
move_59 = Move(Geometry=divide_31.Points, Motion=Z_6)  # -> Geometry, Transform

intcrv_23 = Interpolate(Vertices=move_58.Geometry, Degree=3, Periodic=False, KnotStyle=1)  # -> Curve, Length, Domain
intcrv_24 = Interpolate(Vertices=move_59.Geometry, Degree=3, Periodic=False, KnotStyle=1)  # -> Curve, Length, Domain

join_4 = JoinCurves(Curves=flatten(mirror_13.Geometry), Preserve=False)
join_5 = JoinCurves(Curves=flatten(trim), Preserve=False)
join_6 = JoinCurves(Curves=flatten(trim_2), Preserve=False)
join_7 = JoinCurves(Curves=flatten(mirror_14.Geometry), Preserve=False)
crv_24 = Curve(mirror_7.Geometry)
crv_25 = Curve(ln_7)
item_37 = ListItem(List=flatten(intcrv_23.Curve), Index=0, Wrap=True)
item_38 = ListItem(List=join_5, Index=0, Wrap=True)
item_39 = ListItem(List=join_7, Index=0, Wrap=True)
item_40 = ListItem(List=flatten(intcrv_24.Curve), Index=0, Wrap=True)
item_41 = ListItem(List=join_4, Index=0, Wrap=True)
item_42 = ListItem(List=join_6, Index=0, Wrap=True)
lng_6 = ListLength(List=flatten(join_7))
lng_7 = ListLength(List=flatten(join_4))
swp2_2 = Sweep2(Rail1=flatten(item_41), Rail2=flatten(item_42), Sections=flatten(item_40), SameHeight=False)
swp2_3 = Sweep2(Rail1=flatten(item_38), Rail2=flatten(item_39), Sections=flatten(item_37), SameHeight=False)
multiplication_11 = Multiplication(A=subtraction_3, B="2")
Z_14 = UnitZ(Factor=multiplication_11)
arrlinear_5 = LinearArray(Geometry=swp2_3, Direction=Z_14, Count=lng_6)  # -> Geometry, Transform
arrlinear_6 = LinearArray(Geometry=swp2_2, Direction=Z_14, Count=lng_7)  # -> Geometry, Transform

weave_24 = Weave(Pattern=[0, 1, 2], Stream0=crv_24, Stream1=join_4, Stream2=join_7, NullGaps=False)
weave_25 = Weave(Pattern=[0, 1, 2], Stream0=crv_25, Stream1=join_6, Stream2=join_5, NullGaps=False)
panel_46 = Panel("""2
2
2""")
partition_16 = PartitionList(List=weave_25, Size=panel_46)
partition_17 = PartitionList(List=weave_24, Size=panel_46)
cull_i_19 = CullIndex(List=weave_25, Indices=Slider(0, range=0..100), Wrap=True)
cull_i_20 = CullIndex(List=weave_24, Indices=Slider(0, range=0..100), Wrap=True)
partition_18 = PartitionList(List=cull_i_19, Size=panel_46)
partition_19 = PartitionList(List=cull_i_20, Size=panel_46)
loft_20 = Loft(Curves=partition_17, Options={Adjust=False, Closed=False, LoftEnds=0, LoftSimp=0, LoftType=0, Rebuild=10, Refit=0.01})  # -> flatten(Loft)
loft_21 = Loft(Curves=partition_16, Options={Adjust=False, Closed=False, LoftEnds=0, LoftSimp=0, LoftType=0, Rebuild=10, Refit=0.01})  # -> flatten(Loft)
loft_22 = Loft(Curves=partition_18, Options={Adjust=False, Closed=False, LoftEnds=0, LoftSimp=0, LoftType=0, Rebuild=10, Refit=0.01})
loft_23 = Loft(Curves=partition_19, Options={Adjust=False, Closed=False, LoftEnds=0, LoftSimp=0, LoftType=0, Rebuild=10, Refit=0.01})

weave_26 = Weave(Pattern=[0, 1], Stream0=flatten(loft_21), Stream1=flatten(loft_22), NullGaps=False)
weave_27 = Weave(Pattern=[0, 1, 2], Stream0=loft_8, Stream1=arrlinear_6.Geometry, Stream2=arrlinear_5.Geometry, NullGaps=False)
weave_28 = Weave(Pattern=[0, 1], Stream0=flatten(loft_20), Stream1=flatten(loft_23), NullGaps=False)

divide_32 = DivideCurve(Curve=ln_24, Count="10", Kinks=False)  # -> Points, Tangents, Parameters
divide_33 = DivideCurve(Curve=ln_25, Count="10", Kinks=False)  # -> Points, Tangents, Parameters
move_60 = Move(Geometry=divide_32.Points, Motion=Z_8)  # -> Geometry, Transform
move_61 = Move(Geometry=divide_33.Points, Motion=Z_9)  # -> Geometry, Transform

intcrv_25 = Interpolate(Vertices=move_60.Geometry, Degree=3, Periodic=False, KnotStyle=1)  # -> Curve, Length, Domain
intcrv_26 = Interpolate(Vertices=move_61.Geometry, Degree=3, Periodic=False, KnotStyle=1)  # -> Curve, Length, Domain

# ---- group: osteomorphic surfaces
join_8 = JoinCurves(Curves=flatten(mirror_19.Geometry), Preserve=False)
join_9 = JoinCurves(Curves=flatten(trim_3), Preserve=False)
join_10 = JoinCurves(Curves=flatten(trim_4), Preserve=False)
join_11 = JoinCurves(Curves=flatten(mirror_20.Geometry), Preserve=False)
crv_26 = Curve(ln_10)
crv_27 = Curve(mirror_8.Geometry)
item_43 = ListItem(List=flatten(intcrv_25.Curve), Index=0, Wrap=True)
item_44 = ListItem(List=join_9, Index=0, Wrap=True)
item_45 = ListItem(List=join_11, Index=0, Wrap=True)
item_46 = ListItem(List=flatten(intcrv_26.Curve), Index=0, Wrap=True)
item_47 = ListItem(List=join_8, Index=0, Wrap=True)
item_48 = ListItem(List=join_10, Index=0, Wrap=True)
lng_8 = ListLength(List=flatten(join_11))
lng_9 = ListLength(List=flatten(join_8))
swp2_4 = Sweep2(Rail1=flatten(item_47), Rail2=flatten(item_48), Sections=flatten(item_46), SameHeight=False)
swp2_5 = Sweep2(Rail1=flatten(item_44), Rail2=flatten(item_45), Sections=flatten(item_43), SameHeight=False)
multiplication_12 = Multiplication(A=division_30, B="2")
Z_15 = UnitZ(Factor=multiplication_12)
arrlinear_7 = LinearArray(Geometry=swp2_4, Direction=Z_15, Count=lng_9)  # -> Geometry, Transform
arrlinear_8 = LinearArray(Geometry=swp2_5, Direction=Z_15, Count=lng_8)  # -> Geometry, Transform

# ----
weave_29 = Weave(Pattern=[0, 1, 2], Stream0=crv_26, Stream1=join_10, Stream2=join_9, NullGaps=False)
weave_30 = Weave(Pattern=[0, 1, 2], Stream0=crv_27, Stream1=join_8, Stream2=join_11, NullGaps=False)
merge_11 = Merge(Data1=flatten(weave_30), Data2=crv_19)
merge_12 = Merge(Data1=flatten(weave_29), Data2=crv_18)
panel_47 = Panel(merge_11)
partition_20 = PartitionList(List=merge_12, Size=panel_16)
partition_21 = PartitionList(List=merge_11, Size=panel_16)
cull_i_21 = CullIndex(List=merge_12, Indices=panel_17, Wrap=True)
cull_i_22 = CullIndex(List=merge_11, Indices=panel_17, Wrap=True)
partition_22 = PartitionList(List=cull_i_22, Size=panel_16)
partition_23 = PartitionList(List=cull_i_21, Size=panel_16)
loft_24 = Loft(Curves=partition_20, Options={Adjust=False, Closed=False, LoftEnds=0, LoftSimp=0, LoftType=0, Rebuild=10, Refit=0.01})  # -> flatten(Loft)
loft_25 = Loft(Curves=partition_21, Options={Adjust=False, Closed=False, LoftEnds=0, LoftSimp=0, LoftType=0, Rebuild=10, Refit=0.01})  # -> flatten(Loft)
loft_26 = Loft(Curves=partition_23, Options={Adjust=False, Closed=False, LoftEnds=0, LoftSimp=0, LoftType=0, Rebuild=10, Refit=0.01})
loft_27 = Loft(Curves=partition_22, Options={Adjust=False, Closed=False, LoftEnds=0, LoftSimp=0, LoftType=0, Rebuild=10, Refit=0.01})
weave_31 = Weave(Pattern=[0, 1, 2], Stream0=loft_9, Stream1=arrlinear_7.Geometry, Stream2=arrlinear_8.Geometry, NullGaps=False)

merge_13 = Merge(Data1=flatten(weave_31), Data2=move_35.Geometry)
weave_32 = Weave(Pattern=[0, 1], Stream0=flatten(loft_25), Stream1=flatten(loft_27), NullGaps=False)
weave_33 = Weave(Pattern=[0, 1], Stream0=flatten(loft_24), Stream1=flatten(loft_26), NullGaps=False)

panel_48 = Panel("""0
-1""")
pt_33 = Point(dispatch_19.ListA)
pt_34 = Point(dispatch_18.ListA)
cull_i_23 = CullIndex(List=pt_34, Indices=panel_48, Wrap=True)
cull_i_24 = CullIndex(List=pt_33, Indices=panel_48, Wrap=True)
trim_5 = TrimTree(Tree=cull_i_23, Depth=1)
trim_6 = TrimTree(Tree=cull_i_24, Depth=1)
graft_5 = GraftTree(Tree=trim_6, IncludeEmptyLists=True, IncludeNullItems=True)
tstat_4 = TreeStatistics(Tree=trim_5)  # -> Paths, Length, Count
cull_i_25 = CullIndex(List=tstat_4.Paths, Indices="0", Wrap=True)

cull_i_26 = CullIndex(List=weave_27, Indices="-1", Wrap=True)
cull_i_27 = CullIndex(List=weave_27, Indices="0", Wrap=True)
weave_34 = Weave(
    Pattern=[0, 1, 2, 3],
    Stream0=graft(cull_i_26),
    Stream1=graft(weave_26),
    Stream2=graft(cull_i_27),
    Stream3=graft(weave_28),
    NullGaps=False)
join_12 = BrepJoin(Breps=weave_34)  # -> Breps, Closed
dispatch_20 = Dispatch(List=flatten(join_12.Breps), DispatchPattern=[True, False])  # -> ListA, ListB

brep_11 = Brep(dispatch_20.ListA)
brep_12 = Brep(dispatch_20.ListB)
splitmul_3 = SplitBrepMultiple(Brep=brep_11, Cutters=flatten(planesrf_6))
splitmul_4 = SplitBrepMultiple(Brep=brep_12, Cutters=flatten(planesrf_7))
brep_13 = Brep(splitmul_4)
brep_14 = Brep(splitmul_3)
merge_14 = Merge(Data1=brep_14, Data2=brep_13)
bang_5 = ExplodeTree(Data=brep_14)  # -> Branch0, Branch1, Branch2, Branch3, Branch4, Branch5
bang_6 = ExplodeTree(Data=brep_13)  # -> Branch0, Branch1, Branch2, Branch3, Branch4
merge_15 = Merge(
    Data1=bang_5.Branch0,
    Data2=bang_6.Branch0,
    Data3=bang_5.Branch1,
    Data4=bang_6.Branch1,
    Data5=bang_5.Branch2,
    Data6=bang_6.Branch2,
    Data7=bang_5.Branch3)
panel_49 = Panel(merge_14)
cap_3 = CapHoles(Brep=merge_15)
fmerge = MergeFaces(Brep=cap_3)  # -> Breps, Before, After
brep_15 = Brep(fmerge.Breps)

panel_50 = Panel("""-1
-2""")
panel_51 = Panel("""-1
-2""")
cull_i_28 = CullIndex(List=brep_11, Indices=panel_50, Wrap=True)
cull_i_29 = CullIndex(List=brep_12, Indices=panel_51, Wrap=True)
number_slider_12 = Slider(0.01, range=0..0.01)
weave_35 = Weave(Pattern=[0, 1], Stream0=flatten(cull_i_28), Stream1=flatten(cull_i_29), NullGaps=False)
lng_10 = ListLength(List=weave_35)
series_4 = Series(Start="0", Step=number_slider_12, Count=lng_10)
Z_16 = UnitZ(Factor=series_4)
move_62 = Move(Geometry=weave_35, Motion=Z_16)  # -> Geometry, Transform

dispatch_21 = Dispatch(List=flatten(move_62.Geometry), DispatchPattern=[True, False])  # -> ListA, ListB
splitmul_5 = SplitBrepMultiple(Brep=dispatch_21.ListB, Cutters=flatten(planesrf_7))
splitmul_6 = SplitBrepMultiple(Brep=dispatch_21.ListA, Cutters=flatten(planesrf_6))
panel_52 = Panel(merge_15)
cap_4 = CapHoles(Brep=[splitmul_6, splitmul_5])
fmerge_2 = MergeFaces(Brep=cap_4)  # -> Breps, Before, After
brep_16 = Brep(fmerge_2.Breps)

panel_53 = Panel("""-1
0""")
cull_i_30 = CullIndex(List=weave_27, Indices=panel_53, Wrap=True)
move_63 = Move(Geometry=cull_i_30, Motion=Z_16)  # -> Geometry, Transform
Z_17 = UnitZ(Factor=number_slider_12)
extr_6 = Extrude(Base=move_63.Geometry, Direction=Z_17)

bang_7 = ExplodeTree(Data=partition_5)
bang_8 = ExplodeTree(Data=partition_13)
edges_4 = BrepEdges(Brep=loft_11)  # -> Naked, Interior, NonManifold
edges_5 = BrepEdges(Brep=loft_19)  # -> Naked, Interior, NonManifold
join_13 = JoinCurves(Curves=edges_5.Naked, Preserve=False)
join_14 = JoinCurves(Curves=edges_4.Naked, Preserve=False)
loft_28 = Loft(
    Curves=[join_14, join_13],
    Options={Adjust=False, Closed=False, LoftEnds=0, LoftSimp=0, LoftType=0, Rebuild=10, Refit=0.01})
panel_54 = Panel(edges_4.Naked)
extr_7 = Extrude(Base=flatten(loft_10), Direction=amp)
extrtaper = ExtrudeTaperedPolysurface(Profile=flatten(loft_10), Direction=amp, Angle=2, CornerType=0, FaceMerge=True)

amp_6 = Amplitude(Vector=dispatch_2.ListB, Amplitude=block_width_5)
extr_8 = Extrude(Base=flatten(loft_11), Direction=amp_6)
amp_7 = Amplitude(Vector=dispatch_2.ListA, Amplitude=block_width_5)
extr_9 = Extrude(Base=flatten(loft_10), Direction=amp_7)
sdiff_3 = SolidDifference(BrepsA=extr_8, BrepsB=extr_7)

xz_14 = XZPlane(Origin=flatten(bang_7))
panel_55 = Panel("""0
-1""")
planesrf_8 = PlaneSurface(Plane=xz_14, XSize=Domain(-2, 2), YSize=Domain(-2, 2))
cull_i_31 = CullIndex(List=planesrf_8, Indices=panel_55, Wrap=True)
dispatch_22 = Dispatch(List=cull_i_31, DispatchPattern=[True, False])  # -> ListA, ListB

splitmul_7 = SplitBrepMultiple(Brep=sdiff_3, Cutters=dispatch_22.ListB)
splitmul_8 = SplitBrepMultiple(Brep=extr_9, Cutters=dispatch_22.ListA)

sdiff_4 = SolidDifference(BrepsA=splitmul_8)

# ----
# KANGAROO SHELL- GLASS VAULT
srf_8 = Surface(edgesrf)
pressure = Pressure(Strength=1)
dom_9 = ConstructDomain(DomainStart="0", DomainEnd="1")

branch_9 = TreeBranch(Tree=trim_5, Path=cull_i_25, MaintainPaths=True)
edges_6 = BrepEdges(Brep=loft)  # -> Naked, Interior, NonManifold
fmerge_3 = MergeFaces(Brep=loft)  # -> Breps, Before, After
debrep_7 = DeconstructBrep(Brep=loft)  # -> Faces, Edges, Vertices

graft_6 = GraftTree(Tree=branch_9, IncludeEmptyLists=True, IncludeNullItems=True)
weave_36 = Weave(Pattern=[0, 1], Stream0=graft_6, Stream1=graft_5, NullGaps=False)
item_49 = ListItem(List=weave_36, Index=0, Wrap=True)  # -> Item, Item1
ln_26 = Line(StartPoint=item_49.Item1, EndPoint=item_49.Item)

crv_28 = Curve(flatten([ln_23, ln_26, intcrv_13.Curve, intcrv_14.Curve]))
srfsplit_2 = SurfaceSplit(Surface=crv_15, Curves=crv_28)  # -> flatten(Fragments)
crv_29 = Curve(srfsplit_2)
item_50 = ListItem(List=crv_29, Index=0, Wrap=True)  # -> Item, Item1, Item2, Item3, Item4, Item5, Item6
panel_56 = Panel(crv_29)
maptoshape_13 = MapToShape(MapData=shapemap.MapData, Geometry=flatten(crv_29), Length=1, Pull=False)  # -> Geometry, Normal
panel_57 = Panel(maptoshape_13.Geometry)

mesh = MeshBrep(
    Brep=srf_8,
    Settings={GridMaxCount=0, GridMinCount=16, JaggedSeams=False, MaxEdgeLength=0, MinEdgeLength=0.0001, MinTolerance=0, Refine=True, RefineAngle=0, RelativeTolerance=0.65, SimplePlanes=True, Tolerance=0})
Z_18 = UnitZ(Factor=1)
edgelengths = EdgeLengths(Mesh=mesh, LengthFactor=Slider(0.8, range=0..1), Strength="80")
show = Show(G=mesh)

# ---- group: not used
qrmesh = QuadRemesh(Mesh=mesh, Settings={aqc=True, as=50, dhe=True, gci=0, null=False, pme=0, sa=0, tqc=2000})
demesh = DeconstructMesh(Mesh=qrmesh)  # -> Vertices, Faces, Colours, Normals

# ----
nv = NakedVertices(Mesh=mesh)  # -> ClothedIndex, NakedIndex, ClothedPts, NakedPts
crv_30 = Curve(crv_5)
end_24 = EndPoints(Curve=crv_30)  # -> Start, End
graft_7 = GraftTree(Tree=crv_30, IncludeEmptyLists=True, IncludeNullItems=True)
pt_35 = Point(nv.NakedPts)
crv_cp_4 = CurveClosestPoint(Point=pt_35, Curve=graft_7)  # -> Point, Parameter, Distance
smaller = SmallerThan(FirstNumber=crv_cp_4.Distance, SecondNumber="0.001")  # -> SmallerThan, OrEqualTo
cull = CullPattern(List=pt_35, CullPattern=smaller.SmallerThan)
index_5 = ItemIndex(List=nv.NakedPts, Item=flatten(cull))
cull_i_32 = CullIndex(List=nv.NakedPts, Indices=flatten(index_5), Wrap=True)

medges = MeshEdges(Mesh=mesh)  # -> NakedEdges, InteriorEdges, NonManifoldEdges
crv_31 = Curve([medges.InteriorEdges, medges.NakedEdges])
demesh_2 = DeconstructMesh(Mesh=mesh)  # -> Vertices, Faces, Colours, Normals
amp_8 = Amplitude(Vector=Z_18, Amplitude=Slider(53, range=1..100))
dw = DynamicWeight1d(Line=crv_31, Weight=Slider(2, range=0..500))
medges_2 = MeshEdges(Mesh=mesh)  # -> NakedEdges, InteriorEdges, NonManifoldEdges
len_10 = Length(Curve=[medges_2.NakedEdges, medges_2.InteriorEdges])

anchor = Anchor(Point=flatten([end_24.Start, end_24.End, cull_i_32]), Strength=10000)
load = Load(Point=demesh_2.Vertices, ForceVector=amp_8, Weighting=Slider(10, range=1..10))
merge_16 = Merge(Data1=flatten(show), Data2=flatten(edgelengths), Data3=flatten(dw), Data4=flatten(anchor))
bouncysolver = BouncySolver(GoalObjects=merge_16, Reset=Button(), Threshold=1e-15, Tolerance=0.0001, Damping=0.99, Iterations=10, On=Toggle(False))  # -> I, V, O

item_51 = ListItem(List=bouncysolver.O, Index=0, Wrap=True)
show_2 = Show(G=bouncysolver.V)
medges_3 = MeshEdges(Mesh=item_51)  # -> NakedEdges, InteriorEdges, NonManifoldEdges
len_11 = Length(Curve=[medges_3.NakedEdges, medges_3.InteriorEdges])
division_36 = Division(A=len_11, B=len_10)
bnd_8 = Bounds(Numbers=division_36)
remap_5 = RemapNumbers(Value=division_36, Source=bnd_8, Target=dom_9)  # -> Mapped, Clipped
bnd_9 = Bounds(Numbers=remap_5.Mapped)
gradient_4 = Gradient(
    LowerLimit=0,
    UpperLimit=1,
    Parameter=remap_5.Mapped,
    stops=[0: RGB(216, 30, 25), 0: RGB(255, 0, 0), 0.5: RGB(255, 192, 192)])
panel_58 = Panel(bnd_8)
preview_4 = CustomPreview(Geometry=[medges_3.NakedEdges, medges_3.InteriorEdges], Material=gradient_4)

panel_59 = Panel("""0
-1""")
pt_36 = Point(dispatch_11.ListA)
pt_37 = Point(dispatch_10.ListA)
cull_i_33 = CullIndex(List=pt_37, Indices=panel_59, Wrap=True)
cull_i_34 = CullIndex(List=pt_36, Indices=panel_59, Wrap=True)
trim_7 = TrimTree(Tree=cull_i_33, Depth=1)
trim_8 = TrimTree(Tree=cull_i_34, Depth=1)
graft_8 = GraftTree(Tree=trim_8, IncludeEmptyLists=True, IncludeNullItems=True)
tstat_5 = TreeStatistics(Tree=trim_7)  # -> Paths, Length, Count
cull_i_35 = CullIndex(List=tstat_5.Paths, Indices="0", Wrap=True)

panel_60 = Panel(merge_13)

# ---- group: standard blocks on arch
cull_i_36 = CullIndex(List=merge_13, Indices="-1", Wrap=True)
cull_i_37 = CullIndex(List=merge_13, Indices="0", Wrap=True)
weave_37 = Weave(
    Pattern=[0, 1, 2, 3],
    Stream0=graft(cull_i_36),
    Stream1=graft(weave_33),
    Stream2=graft(cull_i_37),
    Stream3=graft(weave_32),
    NullGaps=False)
angle_4 = Slider(90, range=0..180)
multiplication_13 = Multiplication(A=angle_4, B="0.0174533")

# ---- group: standard blocks on arch / lofts on wall
join_15 = BrepJoin(Breps=weave_37)  # -> Breps, Closed

# ---- group: standard blocks on arch (continued)
rotax = RotateAxis(Geometry=join_15.Breps, Angle=multiplication_13, Axis=crv_17)  # -> Geometry, Transform
dispatch_23 = Dispatch(List=flatten(rotax.Geometry), DispatchPattern=[True, False])  # -> ListA, ListB
flow = Flow(
    Geometry=dispatch_23.ListB,
    Base=crv_17,
    Target=mirror.Geometry,
    ReverseBase=False,
    ReverseTarget=False,
    Stretch=True,
    Rigid=True)

# ----
branch_10 = TreeBranch(Tree=trim_7, Path=cull_i_35, MaintainPaths=True)

graft_9 = GraftTree(Tree=branch_10, IncludeEmptyLists=True, IncludeNullItems=True)
weave_38 = Weave(Pattern=[0, 1], Stream0=graft_9, Stream1=graft_8, NullGaps=False)
item_52 = ListItem(List=weave_38, Index=0, Wrap=True)  # -> Item, Item1
ln_27 = Line(StartPoint=item_52.Item1, EndPoint=item_52.Item)

crv_32 = Curve(flatten([ln_20, ln_27, intcrv_13.Curve, intcrv_14.Curve]))

# ----
# CATENARY VAULT- SIMPLE BRICKS
interlayer_2 = Panel("0.010")
multiplication_14 = Multiplication(A=round.Nearest, B="2")
xz_15 = XZPlane(Origin=Point(0, 0, 0))
planesrf_9 = PlaneSurface(Plane=PlaneXY(0, 0, 0), XSize=Domain(-10, 10), YSize=Domain(-10, 10))
item_53 = ListItem(List=extr_3, Index=0, Wrap=True)  # -> Item1, Item
split_7 = SplitBrep(Brep=[item_53.Item1, item_53.Item], Cutter=planesrf_9)
panel_61 = Panel("""0
-1""")
cull_i_38 = CullIndex(List=flatten(split_7), Indices=panel_61, Wrap=True)
cap_5 = CapHoles(Brep=cull_i_38)
index_6 = ItemIndex(List=extr_3, Item=[item_53.Item, item_53.Item1])
item_54 = ListItem(List=cap_5, Index=0, Wrap=True)  # -> Item, Item1
replace_2 = ReplaceItems(List=extr_3, Item=[item_54.Item1, item_54.Item], Indices=index_6, Wrap=False)

division_37 = Division(A=vault_length_4, B=multiplication_14)
addition_9 = Addition(A=multiplication_14, B="1")
Y_13 = UnitY(Factor=division_37)
arrlinear_9 = LinearArray(Geometry=pt_5, Direction=Y_13, Count=addition_9)  # -> Geometry, Transform

xz_16 = XZPlane(Origin=flatten(arrlinear_9.Geometry))
panel_62 = Panel("""0
-1""")
planesrf_10 = PlaneSurface(Plane=xz_16, XSize=Domain(-2, 2), YSize=Domain(-2, 2))
cull_i_39 = CullIndex(List=planesrf_10, Indices=panel_62, Wrap=True)
dispatch_24 = Dispatch(List=cull_i_39, DispatchPattern=[True, False])  # -> ListA, ListB

# ---- group: INTERLAYER
extr_10 = Extrude(Base=ln_3, Direction=Y_3)
division_38 = Division(A=interlayer_2, B="2")
cull_i_40 = CullIndex(List=flatten(extr_10), Indices=panel_61, Wrap=True)
neg_3 = Negative(Value=division_38)
offsrf = OffsetSurface(Surface=cull_i_40, Distance=division_38, BothSides=neg_3, CreateSolid=True)

# ----
fmerge_4 = MergeFaces(Brep=flow)  # -> Breps, Before, After
panel_63 = Panel(fmerge_4.Breps)

# ---- group: interlayer creation
debrep_8 = DeconstructBrep(Brep=fmerge_4.Breps)  # -> Faces, Edges, Vertices
planar = IsPlanar(Surface=debrep_8.Faces, Interior=True)  # -> Planar, Plane
cull_2 = CullPattern(List=debrep_8.Faces, CullPattern=planar.Planar)
index_7 = ItemIndex(List=debrep_8.Faces, Item=cull_2)
cull_i_41 = CullIndex(List=debrep_8.Faces, Indices=index_7, Wrap=True)
join_16 = BrepJoin(Breps=cull_i_41)  # -> Breps, Closed
md_slider_6 = MDSlider(SliderMode=0, slider_value=Point(0.5, 0.5, 0.5), x_domain=Domain(0, 1), y_domain=Domain(0, 1), z_domain=Domain(0, 1))
item_55 = ListItem(List=cull_2, Index=0, Wrap=True)  # -> Item, Item1
item_56 = ListItem(List=join_16.Breps, Index=0, Wrap=True)  # -> Item, Item1
evalsrf_5 = EvaluateSurface(Surface=reparameterize(item_55.Item1), Point=md_slider_6)  # -> Point, Normal, UDirection, VDirection, Frame
amp_9 = Amplitude(Vector=evalsrf_5.UDirection, Amplitude=interlaayer_thickness)

# ----
extr_11 = Extrude(Base=item_56.Item, Direction=expr("-x", amp_9))
extr_12 = Extrude(Base=item_56.Item1, Direction=amp_9)

# ---- group: for solid difference
item_57 = ListItem(List=flatten(extr_11), Index=0, Wrap=True)  # -> graft(Item)
item_58 = ListItem(List=flatten(extr_12), Index=0, Wrap=True)  # -> graft(Item1), Item
graft_10 = GraftTree(Tree=item_57, IncludeEmptyLists=True, IncludeNullItems=True)
cull_i_42 = CullIndex(List=flatten(extr_11), Indices="0", Wrap=True)
cull_i_43 = CullIndex(List=flatten(extr_12), Indices="-1", Wrap=True)
weave_39 = Weave(Pattern=[0, 1], Stream0=cull_i_43, Stream1=cull_i_42, NullGaps=False)
merge_17 = Merge(Data1=item_57, Data2=weave_39, Data3=item_58.Item1)
lng_11 = ListLength(List=merge_17)
subtraction_5 = Subtraction(A=lng_11, B="2")
division_39 = Division(A=subtraction_5, B="2")
series_5 = Series(Start="2", Step="0", Count=division_39)
merge_18 = Merge(Data1="1", Data2=flatten(series_5), Data3="1")
panel_64 = Panel(merge_18)
partition_24 = PartitionList(List=merge_17, Size=panel_64)

# ----
weave_40 = Weave(Pattern=[0, 1], Stream0=flatten(extr_11), Stream1=flatten(extr_12), NullGaps=False)
dispatch_25 = Dispatch(List=weave_40, DispatchPattern=[True, False])  # -> ListA, ListB

splitmul_9 = SplitBrepMultiple(Brep=flatten(dispatch_25.ListA), Cutters=flatten(dispatch_3.ListB))
splitmul_10 = SplitBrepMultiple(Brep=flatten(dispatch_25.ListB), Cutters=flatten(dispatch_3.ListA))

weave_41 = Weave(Pattern=[0, 1], Stream0=flatten(extr_11), Stream1=flatten(extr_12), NullGaps=False)  # disabled
dispatch_26 = Dispatch(List=weave_41, DispatchPattern=[True, False])  # -> ListA, ListB; disabled

splitmul_11 = SplitBrepMultiple(Brep=flatten(dispatch_26.ListA), Cutters=flatten(dispatch_4.ListB))  # disabled
splitmul_12 = SplitBrepMultiple(Brep=flatten(dispatch_26.ListB), Cutters=flatten(dispatch_4.ListA))  # disabled

cap_6 = CapHoles(Brep=splitmul_11)  # disabled
cap_7 = CapHoles(Brep=splitmul_12)  # disabled
brep_17 = Brep([cap_6, cap_7])  # disabled

# ---- group: offsetting curve after interlayer
panel_65 = Panel("""0
-1""")

# ---- group: angular blocks
brep_18 = Brep(move_23.Geometry)
brep_19 = Brep(extr_2)
merge_19 = Merge(Data1=brep_19, Data2=flatten(join_16.Breps), Data3=brep_18)
xz_17 = XZPlane(Origin=Point(0, 0, 0))
xz_18 = XZPlane(Origin=move_7.Geometry)

# ---- group: offsetting curve after interlayer (continued)
cull_i_44 = CullIndex(List=flatten(merge_19), Indices=panel_65, Wrap=True)
partition_25 = PartitionList(List=flatten(cull_i_44), Size="2")
item_59 = ListItem(List=partition_25, Index=0, Wrap=True)  # -> Item, Item1
move_64 = Move(Geometry=item_59.Item, Motion=expr("-x", amp_9))  # -> Geometry, Transform
move_65 = Move(Geometry=item_59.Item1, Motion=amp_9)  # -> Geometry, Transform
weave_42 = Weave(Pattern=[0, 1], Stream0=flatten(move_64.Geometry), Stream1=flatten(move_65.Geometry), NullGaps=False)
item_60 = ListItem(List=flatten(merge_19), Index=0, Wrap=True)  # -> Item1, Item
merge_20 = Merge(Data1=item_60.Item, Data2=weave_42, Data3=item_60.Item1)

# ---- group: angular blocks (continued)
edges_7 = BrepEdges(Brep=merge_20)  # -> Naked, Interior, NonManifold
crv_33 = Curve(edges_7.Naked)
join_17 = JoinCurves(Curves=crv_33, Preserve=False)
crvalicrvseams = CurveAlignCurveSeams(Curves=join_17, Guide=mirror.Geometry, Snap=True)  # -> Aligned, Points, R
explode_5 = Explode(Curve=crvalicrvseams.Aligned, Recursive=False)  # -> Segments, Vertices
partition_26 = PartitionList(List=flatten(crvalicrvseams.Aligned), Size="2")
pcx = CurvePlane(Curve=flatten(explode_5.Segments), Plane=xz_18)  # -> Points, ParamsC, ParamsP
pcx_2 = CurvePlane(Curve=flatten(explode_5.Segments), Plane=xz_17)  # -> Points, ParamsC, ParamsP
item_61 = ListItem(List=partition_26, Index=0, Wrap=True)  # -> Item, Item1
panel_66 = Panel(pcx_2.Points)
flip_3 = FlipCurve(Curve=item_61.Item)  # -> Curve, Flag
partition_27 = PartitionList(List=flatten(merge_20), Size="2")
loft_29 = Loft(
    Curves=[flip_3.Curve, item_61.Item1],
    Options={Adjust=False, Closed=False, LoftEnds=0, LoftSimp=0, LoftType=0, Rebuild=10, Refit=0.01})
join_18 = BrepJoin(Breps=[loft_29, partition_27])  # -> graft(Breps), Closed
sdiff_5 = SolidDifference(BrepsA=join_18.Breps, BrepsB=partition_24)

# ----
panel_67 = Panel(merge_19)
brep_20 = Brep(sdiff_5)
cap_8 = CapHoles(Brep=splitmul_9)
cap_9 = CapHoles(Brep=splitmul_10)
brep_21 = Brep([cap_8, cap_9])

splitmul_13 = SplitBrepMultiple(Brep=flatten(brep_20), Cutters=flatten(dispatch_3.ListB))
splitmul_14 = SplitBrepMultiple(Brep=flatten(fmerge_4.Breps), Cutters=flatten(dispatch_3.ListA))

panel_68 = Panel(splitmul_13)
cap_10 = CapHoles(Brep=splitmul_13)
cap_11 = CapHoles(Brep=splitmul_14)
brep_22 = Brep([cap_10, cap_11])
panel_69 = Panel(brep_22)
brep_23 = Brep([brep_22, brep_21])

# ----
# CATENARY ARCH- HOLLOW OSTEOMORPHIC BRICKS
debrep_9 = DeconstructBrep(Brep=brep_20)  # -> Faces, Edges, Vertices; disabled
panel_70 = Panel("""0
5""")  # disabled
cull_i_45 = CullIndex(List=debrep_9.Faces, Indices=panel_70, Wrap=True)  # disabled
join_19 = BrepJoin(Breps=cull_i_45)  # -> Breps, Closed; disabled

panel_71 = Panel("2")  # disabled
division_40 = Division(A=vault_length_3, B=panel_71)  # disabled
Y_14 = UnitY(Factor=expr("-x", division_40))  # disabled
move_66 = Move(Geometry=brep_23, Motion=Y_14)  # -> Geometry, Transform; disabled
sdiff_6 = SolidDifference(BrepsA=move_66.Geometry, BrepsB=sdiff)  # -> flatten(Result); disabled
area_6 = Area(Geometry=sdiff_6)  # -> Area, Centroid; disabled
panel_72 = Panel("""true
true
true
true
true
false
false
false
false
false""")  # disabled
brepinc = PointInBrep(Brep=box, Point=area_6.Centroid, Strict=False)  # disabled
cull_3 = CullPattern(List=sdiff_6, CullPattern=brepinc)  # disabled
dispatch_27 = Dispatch(List=cull_3, DispatchPattern=panel_72)  # -> ListA, ListB; disabled
brep_24 = Brep([dispatch_27.ListA, dispatch_27.ListB])  # disabled

trim_9 = TrimTree(Tree=join_19.Breps, Depth=panel_10)  # disabled

splitmul_15 = SplitBrepMultiple(Brep=flatten(trim_9), Cutters=flatten(dispatch_4.ListB))  # disabled
splitmul_16 = SplitBrepMultiple(Brep=flatten(fmerge_4.Breps), Cutters=flatten(dispatch_4.ListA))  # disabled

panel_73 = Panel(splitmul_15)  # disabled
panel_74 = Panel(trim_9)  # disabled
cap_12 = CapHoles(Brep=splitmul_15)  # disabled
cap_13 = CapHoles(Brep=splitmul_16)  # disabled
brep_25 = Brep([splitmul_15, splitmul_16])  # disabled
panel_75 = Panel(brep_25)  # disabled
brep_26 = Brep([brep_25, brep_17])  # disabled

panel_76 = Panel("2")  # disabled
division_41 = Division(A=vault_length_3, B=panel_76)  # disabled
Y_15 = UnitY(Factor=expr("-x", division_41))  # disabled
move_67 = Move(Geometry=brep_26, Motion=Y_15)  # -> Geometry, Transform; disabled
sdiff_7 = SolidDifference(BrepsA=move_67.Geometry, BrepsB=sdiff_2)  # -> flatten(Result); disabled
area_7 = Area(Geometry=sdiff_7)  # -> Area, Centroid; disabled
panel_77 = Panel("""true
true
true
true
true
false
false
false
false
false""")  # disabled
brepinc_2 = PointInBrep(Brep=box_3, Point=area_7.Centroid, Strict=False)  # disabled
cull_4 = CullPattern(List=sdiff_7, CullPattern=brepinc_2)  # disabled
dispatch_28 = Dispatch(List=cull_4, DispatchPattern=panel_77)  # -> ListA, ListB; disabled
brep_27 = Brep([dispatch_28.ListA, dispatch_28.ListB])  # disabled

panel_78 = Panel(cull_3)

multiplication_15 = Multiplication(A=division, B="1000")
multiplication_16 = Multiplication(A=interlaayer_thickness, B="1000")
py3_6 = Python3Script(geometry=flatten(brep_24), thickness=multiplication_15)  # -> out, a; inputs geometry: list of Brep; disabled
# ---------- py3_6: Python ----------
import Rhino
import scriptcontext as sc
import System
import os

def export_step(geo_input, export_path, T_value):
    sc.doc = Rhino.RhinoDoc.ActiveDoc

    # Create a file name from slider values
    file_name = f"T{T_value}"
    full_path = os.path.join(export_path, file_name + ".step")

    # Wrap single input in list if necessary
    geo_list = geo_input if isinstance(geo_input, list) else [geo_input]

    obj_ids = []
    success = False

    print(f"Number of Breps: {len(geo_list)}")

    # Create a temporary layer for exporting
    temp_layer_name = "Temp_Export_Layer"
    temp_layer_index = sc.doc.Layers.FindByFullPath(temp_layer_name, True)
    if temp_layer_index == -1:
        temp_layer_index = sc.doc.Layers.Add(temp_layer_name, System.Drawing.Color.Red)

    for i, geo in enumerate(geo_list):
        print(f"Processing Brep {i}...")
        if not geo.IsValid:
            print(f"❌ Brep {i} is invalid, skipping")
            continue

        if isinstance(geo, Rhino.Geometry.Brep):
            attr = Rhino.DocObjects.ObjectAttributes()
            attr.LayerIndex = temp_layer_index
            guid = sc.doc.Objects.AddBrep(geo, attr)
        else:
            print(f"⚠️ Unsupported geometry type at index {i}: {type(geo)}")
            continue

        if guid != System.Guid.Empty:
            obj_ids.append(guid)

    if obj_ids:
        # Select all added objects
        for guid in obj_ids:
            sc.doc.Objects.Select(guid, True)

        # Run export command
        export_command = f'-_Export "{full_path}" _Enter'
        success = Rhino.RhinoApp.RunScript(export_command, False)
        print(f"Export command success: {success}")

    # Clean up: delete added objects
    for guid in obj_ids:
        sc.doc.Objects.Delete(guid, True)

    # Delete the temporary layer (if empty)
    try:
        if temp_layer_index != -1:
            layer = sc.doc.Layers[temp_layer_index]
            if layer and not layer.IsDeleted:
                sc.doc.Layers.Delete(temp_layer_index, True)
    except Exception as e:
        print(f"⚠️ Could not delete temp layer: {e}")

    return "✅ Exported: " + full_path if success else "❌ Export failed"

# === INPUTS from Grasshopper ===
geometry = geometry
T = int(thickness)

export_path = r'D:\ANSYS BT\07 Vaultparametric\geometry dataset'

a = export_step(geometry, export_path, T)
# ---------- end py3_6 ----------
colibri_in = ColibriInputsIterator(RemoteFly=Toggle(False), Input=index_2, ignoreAllWarningMsg=True)  # -> UniqueName, Inputs, Index
panel_79 = Panel(py3_6.a)

panel_80 = Panel(cull_4)  # disabled

panel_81 = Panel("1000")  # disabled
panel_82 = Panel("1000")  # disabled
multiplication_17 = Multiplication(A=division_2, B=panel_81)  # disabled
multiplication_18 = Multiplication(A=division_3, B=panel_82)  # disabled
py3_7 = Python3Script(geometry=flatten(brep_27), thickness=multiplication_17, interlayer_thickness=multiplication_18)  # -> out, a; inputs geometry: list of Brep; disabled
# ---------- py3_7: Python ----------
import Rhino
import scriptcontext as sc
import System
import os

def export_step(geo_input, export_path, T_value, I_value):
    sc.doc = Rhino.RhinoDoc.ActiveDoc

    # Create a file name from slider values
    file_name = f"T{T_value}I{I_value}"
    full_path = os.path.join(export_path, file_name + ".step")

    # Wrap single input in list if necessary
    geo_list = geo_input if isinstance(geo_input, list) else [geo_input]

    obj_ids = []
    success = False

    print(f"Number of Breps: {len(geo_list)}")

    # Create a temporary layer for exporting
    temp_layer_name = "Temp_Export_Layer"
    temp_layer_index = sc.doc.Layers.FindByFullPath(temp_layer_name, True)
    if temp_layer_index == -1:
        temp_layer_index = sc.doc.Layers.Add(temp_layer_name, System.Drawing.Color.Red)

    for i, geo in enumerate(geo_list):
        print(f"Processing Brep {i}...")
        if not geo.IsValid:
            print(f"❌ Brep {i} is invalid, skipping")
            continue

        if isinstance(geo, Rhino.Geometry.Brep):
            attr = Rhino.DocObjects.ObjectAttributes()
            attr.LayerIndex = temp_layer_index
            guid = sc.doc.Objects.AddBrep(geo, attr)
        else:
            print(f"⚠️ Unsupported geometry type at index {i}: {type(geo)}")
            continue

        if guid != System.Guid.Empty:
            obj_ids.append(guid)

    if obj_ids:
        # Select all added objects
        for guid in obj_ids:
            sc.doc.Objects.Select(guid, True)

        # Run export command
        export_command = f'-_Export "{full_path}" _Enter'
        success = Rhino.RhinoApp.RunScript(export_command, False)
        print(f"Export command success: {success}")

    # Clean up: delete added objects
    for guid in obj_ids:
        sc.doc.Objects.Delete(guid, True)

    # Delete the temporary layer (if empty)
    try:
        if temp_layer_index != -1:
            layer = sc.doc.Layers[temp_layer_index]
            if layer and not layer.IsDeleted:
                sc.doc.Layers.Delete(temp_layer_index, True)
    except Exception as e:
        print(f"⚠️ Could not delete temp layer: {e}")

    return "✅ Exported: " + full_path if success else "❌ Export failed"

# === INPUTS from Grasshopper ===
geometry = geometry
T = int(thickness)
I = int(interlayer_thickness)
export_path = r'D:\ANSYS BT\04 Arch3Dparametric setup\Geometry dataset- sampled'

a = export_step(geometry, export_path, T, I)
# ---------- end py3_7 ----------
colibri_in_2 = ColibriInputsIterator(R=toggle, Index=index, ignoreAllWarningMsg=True)  # -> U, IP, Index, V_N; disabled
panel_83 = Panel(py3_7.a)  # disabled

offcrv = OffsetCurve(Curve=ln_3, Plane=xz_15, Distance=division_38, BothSides=0, Kinks=0, CapType=1)
trim_10 = TrimSolid(Shape=replace_2, Cutters=flatten(offsrf))
cap_14 = CapHoles(Brep=trim_10)
dispatch_29 = Dispatch(List=flatten(cap_14), DispatchPattern=[True, False])  # -> ListA, ListB

splitmul_17 = SplitBrepMultiple(Brep=flatten(dispatch_29.ListB), Cutters=flatten(dispatch_24.ListA))
splitmul_18 = SplitBrepMultiple(Brep=flatten(dispatch_29.ListA), Cutters=flatten(dispatch_24.ListB))

cap_15 = CapHoles(Brep=splitmul_17)
cap_16 = CapHoles(Brep=splitmul_18)
brep_28 = Brep([splitmul_18, splitmul_17, offsrf])
merge_21 = Merge(Data1=cap_16, Data2=cap_15)
brep_29 = Brep(merge_21)

division_42 = Division(A=vault_length_3, B="2")
Y_16 = UnitY(Factor=expr("-x", division_42))
move_68 = Move(Geometry=brep_23, Motion=Y_16)  # -> Geometry, Transform
dom_10 = ConstructDomain(DomainStart=0, DomainEnd=arch_height_m_3)
panel_84 = Panel("""true
true
true
true
true
false
false
false
false
false""")

box_5 = DomainBox(Base=PlaneXY(0, 0, 0), X=Domain(-2, 2), Y=Domain(-1, 0), Z=dom_10)
box_6 = DomainBox(Base=PlaneXY(0, 0, 0), X=Domain(-2, 2), Y=Domain(0, 1), Z=dom_10)
brep_30 = Brep(box_5)

sdiff_8 = SolidDifference(BrepsA=move_68.Geometry, BrepsB=brep_30)  # -> flatten(Result)
area_8 = Area(Geometry=sdiff_8)  # -> Area, Centroid
brepinc_3 = PointInBrep(Brep=box_6, Point=area_8.Centroid, Strict=False)
cull_5 = CullPattern(List=sdiff_8, CullPattern=brepinc_3)
dispatch_30 = Dispatch(List=cull_5, DispatchPattern=panel_84)  # -> ListA, ListB
brep_31 = Brep([dispatch_30.ListA, dispatch_30.ListB])

panel_85 = Panel(brepinc_3)

multiplication_19 = Multiplication(A=division, B="1000")
py3_8 = Python3Script(geometry=flatten(brep_31), thickness=multiplication_19)  # -> out, a; inputs geometry: list of Brep
# ---------- py3_8: Python ----------
import Rhino
import scriptcontext as sc
import System
import os

def export_step(geo_input, export_path, T_value):
    sc.doc = Rhino.RhinoDoc.ActiveDoc

    # Create a file name from slider values
    file_name = f"T{T_value}"
    full_path = os.path.join(export_path, file_name + ".step")

    # Wrap single input in list if necessary
    geo_list = geo_input if isinstance(geo_input, list) else [geo_input]

    obj_ids = []
    success = False

    print(f"Number of Breps: {len(geo_list)}")

    # Create a temporary layer for exporting
    temp_layer_name = "Temp_Export_Layer"
    temp_layer_index = sc.doc.Layers.FindByFullPath(temp_layer_name, True)
    if temp_layer_index == -1:
        temp_layer_index = sc.doc.Layers.Add(temp_layer_name, System.Drawing.Color.Red)

    for i, geo in enumerate(geo_list):
        print(f"Processing Brep {i}...")
        if not geo.IsValid:
            print(f"❌ Brep {i} is invalid, skipping")
            continue

        if isinstance(geo, Rhino.Geometry.Brep):
            attr = Rhino.DocObjects.ObjectAttributes()
            attr.LayerIndex = temp_layer_index
            guid = sc.doc.Objects.AddBrep(geo, attr)
        else:
            print(f"⚠️ Unsupported geometry type at index {i}: {type(geo)}")
            continue

        if guid != System.Guid.Empty:
            obj_ids.append(guid)

    if obj_ids:
        # Select all added objects
        for guid in obj_ids:
            sc.doc.Objects.Select(guid, True)

        # Run export command
        export_command = f'-_Export "{full_path}" _Enter'
        success = Rhino.RhinoApp.RunScript(export_command, False)
        print(f"Export command success: {success}")

    # Clean up: delete added objects
    for guid in obj_ids:
        sc.doc.Objects.Delete(guid, True)

    # Delete the temporary layer (if empty)
    try:
        if temp_layer_index != -1:
            layer = sc.doc.Layers[temp_layer_index]
            if layer and not layer.IsDeleted:
                sc.doc.Layers.Delete(temp_layer_index, True)
    except Exception as e:
        print(f"⚠️ Could not delete temp layer: {e}")

    return "✅ Exported: " + full_path if success else "❌ Export failed"

# === INPUTS from Grasshopper ===
geometry = geometry
T = int(thickness)

export_path = r'D:\ANSYS BT\09 VaultParametric with eccentric loading\geometry dataset'

a = export_step(geometry, export_path, T)
# ---------- end py3_8 ----------
colibri_in_3 = ColibriInputsIterator(RemoteFly=Toggle(False), Input=index_2, ignoreAllWarningMsg=True)  # -> UniqueName, Inputs, Index
panel_86 = Panel(py3_8.a)

# ----
# 2D CATENARY arch- SIMPLE BRICKS
interlayer_3 = Panel("0.010")

interlayer_thickness = Panel(division_10)
pt_38 = Point("0,0,0")
division_43 = Division(A=arch_height_m_5, B=block_height_6)
round_14 = Round(Number=division_43)  # -> Nearest, Floor, Ceiling
division_44 = Division(A=arch_span_m_5, B="2")
X_32 = UnitX(Factor=expr("-x", division_44))
X_33 = UnitX(Factor=division_44)
move_69 = Move(Geometry=pt_38, Motion=X_33)  # -> Geometry, Transform
move_70 = Move(Geometry=pt_38, Motion=X_32)  # -> Geometry, Transform
Y_17 = UnitY(Factor=1)
cat_6 = Catenary(PointA=move_69.Geometry, PointB=move_70.Geometry, Length=arch_height_m_5, Gravity=Y_17)

py3_9 = Python3Script(x=round_14.Floor)  # -> out, a; same code as py3

subtraction_6 = Subtraction(A=py3_9.a, B="1")
multiplication_20 = Multiplication(A=subtraction_6, B=interlayer_thickness)
subtraction_7 = Subtraction(A=arch_height_m_5, B=multiplication_20)
division_45 = Division(A=subtraction_7, B=py3_9.a)
series_6 = Series(Start=interlayer_thickness, Step="0", Count=subtraction_6)
series_7 = Series(Start=division_45, Step="0", Count=py3_9.a)
weave_43 = Weave(Pattern=[0, 1], Stream0=series_7, Stream1=series_6, NullGaps=False)
dash = DashPattern(Curve=cat_6, Pattern=weave_43)  # -> Dashes, Gaps
crv_34 = Curve(dash.Dashes)
crv_35 = Curve(dash.Gaps)
end_25 = EndPoints(Curve=crv_34)  # -> Start, End
ln_28 = Line(StartPoint=end_25.Start, EndPoint=end_25.End)

weave_44 = Weave(Pattern=[0, 1], Stream0=end_25.Start, Stream1=end_25.End, NullGaps=False)

offset_4 = OffsetCurve(Curve=cat_6, Distance=expr("-x", division_11), Plane=cat_6, Corners=1)
end_26 = EndPoints(Curve=cat_6)  # -> Start, End
ln_29 = Line(StartPoint=end_26.Start, EndPoint=end_26.End)
ccx = CurveCurve(CurveA=flatten(ln_29), CurveB=flatten(offset_4))  # -> flatten(Points), ParamsA, ParamsB
shatter_7 = Shatter(Curve=offset_4, Parameters=flatten(ccx.ParamsB))
item_62 = ListItem(List=shatter_7, Index=0, Wrap=True)  # -> Item, Item1
Z_19 = UnitZ(Factor=1)
crv_36 = Curve(item_62.Item1)
crv_cp_5 = CurveClosestPoint(Point=weave_44, Curve=crv_36)  # -> Point, Parameter, Distance
ln_30 = Line(StartPoint=crv_cp_5.Point, EndPoint=weave_44)
loft_30 = Loft(
    Curves=flatten([crv_36, cat_6]),
    Options={Adjust=False, Closed=False, LoftEnds=0, LoftSimp=0, LoftType=0, Rebuild=10, Refit=0.01})
extr_13 = Extrude(Base=ln_30, Direction=Z_19)
splitmul_19 = SplitBrepMultiple(Brep=flatten(loft_30), Cutters=flatten(extr_13))
brep_32 = Brep(splitmul_19)

fmerge_5 = MergeFaces(Brep=brep_32)  # -> Breps, Before, After

brep_33 = Brep(fmerge_5.Breps)

dispatch_31 = Dispatch(List=fmerge_5.Breps, DispatchPattern=[True, False])  # -> ListA, flatten(ListB)
srf_9 = Surface(dispatch_31.ListA)
# 2D CATENARY arch- HOLLOW BRICKS
edges_8 = BrepEdges(Brep=dispatch_31.ListA)  # -> Naked, Interior, NonManifold
join_20 = JoinCurves(Curves=edges_8.Naked, Preserve=False)
Z_20 = UnitZ(Factor=1)
offset_5 = OffsetCurve(Curve=join_20, Distance="-0.011", Corners=1)
extr_14 = Extrude(Base=offset_5, Direction=Z_20)
splitmul_20 = SplitBrepMultiple(Brep=flatten(srf_9), Cutters=flatten(extr_14))
item_63 = ListItem(List=splitmul_20, Index=0, Wrap=True)  # -> flatten(Item)

crv_37 = Curve(flatten(join_20))
crv_38 = Curve(flatten(offset_5))
weave_45 = Weave(Pattern=[0, 1], Stream0=crv_37, Stream1=crv_38, NullGaps=False)
partition_28 = PartitionList(List=weave_45, Size="2")
loft_31 = Loft(Curves=partition_28, Options={Adjust=False, Closed=False, LoftEnds=0, LoftSimp=0, LoftType=0, Rebuild=10, Refit=0.01})  # -> flatten(Loft)

weave_46 = Weave(Pattern=[0, 1], Stream0=loft_31, Stream1=dispatch_31.ListB, NullGaps=False)

fmerge_6 = MergeFaces(Brep=weave_46)  # -> Breps, Before, After

brep_34 = Brep(weave_46)

panel_87 = Panel(brep_34)
fmerge_7 = MergeFaces(Brep=loft_31)  # -> Breps, Before, After

multiplication_21 = Multiplication(A=division_11, B="1000")
multiplication_22 = Multiplication(A=division_10, B="1000")
sub_domain = ColibriIterationSubdomain()
panel_88 = Panel(interlayer_3)
py3_10 = Python3Script(geometry=flatten(brep_34), thickness=multiplication_21, interlayer_stiffness=multiplication_22)  # -> out, a; inputs geometry: list of Brep; disabled; same code as py3_2
colibri_in_4 = ColibriInputsIterator(RemoteFly=Toggle(False), Input=index_3, ignoreAllWarningMsg=True)  # -> UniqueName, Inputs, Index

panel_89 = Panel(py3_10.a)
