# Grasshopper definition Kirigami v2.3 morph.gh (Grasshopper 1.0.8)
# plug-ins: RhinoCodePluginGH, Pufferfish, CORE.Grasshopper.Colibri, LunchBox, Kangaroo2 Components

# ---- group: ACTIVATION
angle = Slider(60, range=0..180)
multiplication = Multiplication(A=angle, B="0.0174533")

# ----
# KIRIGAMI
H = Panel("5.8")
W = Panel("1.2")
L = Panel("5.8")
amplitude = Slider(50, range=10..100)
# OSTEOMORPHIC  SHAPE
panel = Panel("300")
number_slider = Slider(0.006, range=0.006..0.025)

# ---- group: SINE COSINE CURVE
series = Series(Start=0, Step=Slider(0.1, range=0..1), Count=Slider(67, range=0..100))
hilonums = HighestLowestNumbers(Numbers=series)  # -> Highest, Lowest
division = Division(A=hilonums.Highest, B="2")
expression = Expression(x=series, Expression="sin(x-π/2)")
pi = Pi(Factor="2")
pt = ConstructPoint(XCoordinate=series, YCoordinate=expression, ZCoordinate=0)
item = ListItem(List=pt, Index=0, Wrap=True)
X = UnitX(Factor=pi)
intcrv = Interpolate(Vertices=pt, Degree=3, Periodic=False, KnotStyle=1)  # -> Curve, Length, Domain
move = Move(Geometry=item, Motion=X)  # -> Geometry, Transform
ptstrimcrv = PointsTrimCurve(Curve=intcrv.Curve, Points=move.Geometry, Flip=False)  # -> Trimmed, SubDomains, Intersected

# ----
division_2 = Division(A="150", B="2")
X_2 = UnitX(Factor=expr("-x", division_2))
pt_2 = Point("0,0,0")
move_2 = Move(Geometry=pt_2, Motion=X_2)  # -> Geometry, Transform
Y = UnitY(Factor=panel)
move_3 = Move(Geometry=move_2.Geometry, Motion=Y)  # -> Geometry, Transform
ln = Line(StartPoint=move_2.Geometry, EndPoint=move_3.Geometry)
divide = DivideCurve(Curve=ln, Count="10", Kinks=False)  # -> Points, Tangents, Parameters
end = EndPoints(Curve=ln)  # -> Start, End

panel_2 = Panel(end.Start)
panel_3 = Panel("42")
Y_2 = UnitY(Factor=H)

end_2 = EndPoints(Curve=ptstrimcrv.Trimmed)  # -> Start, End
ln_2 = Line(StartPoint=end_2.Start, EndPoint=end_2.End)
Y_3 = UnitY(Factor="1")
move_4 = Move(Geometry=ln_2, Motion=Y_3)  # -> Geometry, Transform
divide_2 = DivideCurve(Curve=ptstrimcrv.Trimmed, Count="10", Kinks=False)  # -> Points, Tangents, Parameters
crv_cp = CurveClosestPoint(Point=divide_2.Points, Curve=ln_2)  # -> Point, Parameter, Distance
dist = Distance(PointA=divide_2.Points, PointB=crv_cp.Point)
bnd = Bounds(Numbers=dist)

division_3 = Division(A=amplitude, B="2")
neg = Negative(Value=division_3)
dom = ConstructDomain(DomainStart=neg, DomainEnd=division_3)
remap = RemapNumbers(Value=dist, Source=bnd, Target=dom)  # -> Mapped, Clipped

Z = UnitZ(Factor=remap.Mapped)
Z_2 = UnitZ(Factor=expr("-x", remap.Mapped))
move_5 = Move(Geometry=divide.Points, Motion=Z)  # -> Geometry, Transform
intcrv_2 = Interpolate(Vertices=move_5.Geometry, Degree=3, Periodic=False, KnotStyle=1)  # -> Curve, Length, Domain
X_3 = UnitX(Factor="150")
move_6 = Move(Geometry=intcrv_2.Curve, Motion=X_3)  # -> Geometry, Transform
bbox = BoundingBox(Content=move_6.Geometry, Plane=PlaneXY(0, 0, 0))  # -> Box, Box_2
area = Area(Geometry=bbox.Box)  # -> Area, Centroid
xy = XYPlane(Origin=area.Centroid)
mirror = Mirror(Geometry=move_6.Geometry, Plane=xy)  # -> Geometry, Transform

midpt = CurveMiddle(Curve=ptstrimcrv.Trimmed)
midpt_2 = CurveMiddle(Curve=ln_2)
ptstrimcrv_2 = PointsTrimCurve(Curve=intcrv.Curve, Points=midpt, Flip=False)  # -> Trimmed, SubDomains, Intersected
ln_3 = Line(StartPoint=item, EndPoint=midpt_2)
divide_3 = DivideCurve(Curve=ln_3, Count="10", Kinks=False)  # -> Points, Tangents, Parameters
divide_4 = DivideCurve(Curve=ptstrimcrv_2.Trimmed, Count="10", Kinks=False)  # -> Points, Tangents, Parameters
dist_2 = Distance(PointA=divide_4.Points, PointB=divide_3.Points)
bnd_2 = Bounds(Numbers=dist_2)
remap_2 = RemapNumbers(Value=dist_2, Source=bnd_2, Target=dom)  # -> Mapped, Clipped

yz = YZPlane(Origin=Point(0, 0, 0))
mirror_2 = Mirror(Geometry=ln, Plane=yz)  # -> Geometry, Transform
crv = Curve(mirror_2.Geometry)
end_3 = EndPoints(Curve=crv)  # -> Start, End
ln_4 = Line(StartPoint=end_3.Start, EndPoint=end.Start)
divide_5 = DivideCurve(Curve=ln_4, Count="10", Kinks=False)  # -> Points, Tangents, Parameters
Z_3 = UnitZ(Factor=expr("-X", remap_2.Mapped))
move_7 = Move(Geometry=divide_5.Points, Motion=Z_3)  # -> Geometry, Transform
intcrv_3 = Interpolate(Vertices=move_7.Geometry, Degree=3, Periodic=False, KnotStyle=1)  # -> Curve, Length, Domain

panel_4 = Panel(remap.Mapped)

# ---- group: size of interlayer
len = Length(Curve=intcrv_3.Curve)
len_2 = Length(Curve=intcrv_2.Curve)

# ----
swp2 = Sweep2(Rail1=mirror.Geometry, Rail2=intcrv_2.Curve, Sections=intcrv_3.Curve, SameHeight=False)
panel_5 = Panel(len_2)
rebuildsrf = RebuildSurface(Surface=swp2, UDegree=3, VDegree=3, UNumber=10, VNumber=10)
brep = Brep([<brep referenced from the Rhino model> x2])
item_2 = ListItem(List=brep, Index=0, Wrap=True)  # -> Item, Item1
brep_2 = Brep([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])
xy_2 = XYPlane(Origin=Point(0, 0, 0))
crossref = CrossReference(ListA=brep, ListB=brep, CrossMode=5)  # -> ListA, ListB
panel_6 = Panel(crossref.ListB)
volume = Volume(Geometry=brep)  # -> Volume, Centroid
number_slider_2 = Slider(10, range=0..10)
Z_4 = UnitZ(Factor=expr("-x", Slider(0.01, range=0..0.01)))
crossref_2 = CrossReference(ListA=brep_2, ListB=brep_2, CrossMode=5)  # -> ListA, ListB
volume_2 = Volume(Geometry=brep_2)  # -> Volume, Centroid
Z_5 = UnitZ(Factor=-0.01)
solidplanecollide = SolidPlaneCollide(Solid=brep, SolidPlane=xy_2, CollisionPlane=PlaneXY(0, 0, 0), Strength=1)
rigidbody = RigidBody(Part=brep, Strength=10)  # -> RigidBody, Planes
solidcollide = SolidCollide(MeshA=brep, MeshB=brep, Strength=1)
solidplanecollide_2 = SolidPlaneCollide(Solid=brep_2, CollisionPlane=PlaneXY(0, 0, 0), Strength=1)
rigidbody_2 = RigidBody(Part=brep_2, Strength=1)
solidcollide_2 = SolidCollide(MeshA=crossref_2.ListA, MeshB=crossref_2.ListB, Strength=1)
grab = Grab(On=True, Strength=1, Range=3)  # -> Grab, Anchors
load = Load(Point=volume.Centroid, ForceVector=Z_4)
load_2 = Load(Point=volume.Centroid, ForceVector=Z_4, Weighting=1)
load_3 = Load(Point=volume_2.Centroid, ForceVector=Z_5)
H_2 = Slider(8.7, range=5.8..10)
W_2 = Panel("1.2")
bouncysolver = BouncySolver(
    GoalObjects=[rigidbody_2, grab.Grab, solidcollide_2, solidplanecollide_2, load_3],
    Reset=Button(),
    Threshold=1e-07,
    Tolerance=0.01,
    Damping=0.99,
    Iterations=10,
    On=Toggle(False))  # -> I, V, O
division_4 = Division(A=W_2, B=H_2)
bouncysolver_2 = BouncySolver(
    GoalObjects=[solidplanecollide, rigidbody.RigidBody, solidcollide, load_2],
    Reset=Button(),
    Threshold=1e-07,
    Tolerance=0.01,
    Damping=0.99,
    Iterations=10,
    On=Toggle(False))  # -> I, V, O
multiplication_2 = Multiplication(A=H_2, B=division_4)
fmerge = MergeFaces()  # -> Breps, Before, After
colourful = Colourful(geo=bouncysolver.O)
brep_3 = Brep(fmerge.Breps)

# ---- group: ACTIVATION
angle_2 = Slider(50, range=30..75)
multiplication_3 = Multiplication(A=angle_2, B="0.0174533")

# ----
W_3 = Panel(multiplication_2)
W_4 = Panel(W_3)
L_2 = Panel(H_2)
H_3 = Panel(H_2)
Y_4 = UnitY(Factor=H_3)

# ---- group: Vertical flaps Tilt angle from vertical
angle_3 = Slider(15, range=0..60)
multiplication_4 = Multiplication(A=angle_3, B="0.0174533")

# ----
brep_4 = Brep(<brep referenced from the Rhino model>)
bbox_2 = BoundingBox(Content=brep_4, Plane=PlaneXY(0, 0, 0))  # -> Box, Box_2
debrep = DeconstructBrep(Brep=bbox_2.Box)  # -> Faces, Edges, Vertices
item_3 = ListItem(List=debrep.Faces, Index=0, Wrap=True)  # -> Item, Item1, Item2, Item3, Item4, Item5
number_slider_3 = Slider(2, range=1..50)

number_slider_4 = Slider(27, range=5..100)
pt_3 = Point("0,0,0")
cos = Cosine(Value=multiplication)
sin = Sine(Value=multiplication)
multiplication_5 = Multiplication(A=sin, B=L)
multiplication_6 = Multiplication(A=cos, B=L)
panel_7 = Panel("""0
0
1
1""")
Y_5 = UnitY(Factor=multiplication_6)

addition = Addition(A=W, B=multiplication_5)
addition_2 = Addition(A=multiplication_6, B=H)

# ---- group: SIZING
panel_8 = Panel(len)
panel_9 = Panel(len_2)
addition_3 = Addition(A=multiplication_5, B=W)
division_5 = Division(A=panel_8, B=addition_2)
division_6 = Division(A=panel_9, B=addition_3)
int = Integer(division_5)
int_2 = Integer(expr("x+2", division_6))
division_7 = Division(A=int, B="2")
panel_10 = Panel(int_2)
int_3 = Integer(division_7)

# ----
series_2 = Series(Start=multiplication_5, Step="0", Count=panel_10)
series_3 = Series(Start=W, Step="0", Count=panel_10)
weave = Weave(Pattern=[0, 1], Stream0=series_3, Stream1=series_2, NullGaps=False)
ma = MassAddition(Input=weave)  # -> Result, PartialResults
X_4 = UnitX(Factor=ma.PartialResults)
move_8 = Move(Geometry=pt_3, Motion=flatten(X_4))  # -> Geometry, Transform
merge = Merge(Data1=pt_3, Data2=move_8.Geometry)
pt_4 = Point(merge)
dispatch = Dispatch(List=pt_4, DispatchPattern=panel_7)  # -> ListA, ListB
pt_5 = Point(dispatch.ListA)
move_9 = Move(Geometry=pt_5, Motion=Y_5)  # -> Geometry, Transform
pt_6 = Point(dispatch.ListB)

move_10 = Move(Geometry=move_9.Geometry, Motion=Y_2)  # -> Geometry, Transform

panel_11 = Panel("""0
1
1
0""")
weave_2 = Weave(Pattern=panel_11, Stream0=move_9.Geometry, Stream1=move_10.Geometry, NullGaps=False)
partition = PartitionList(List=weave_2, Size="4")
tstat = TreeStatistics(Tree=partition)  # -> Paths, Length, Count
lng = ListLength(List=tstat.Paths)
subtraction = Subtraction(A=lng, B="1")
cull_i = CullIndex(List=tstat.Paths, Indices=subtraction, Wrap=True)
split = SplitTree(Data=partition, Masks=flatten(cull_i))  # -> Positive, Negative
item_4 = ListItem(List=split.Positive, Index=0, Wrap=True)  # -> Item, Item1, Item2, Item3
srf4pt = _4PointSurface(CornerA=item_4.Item, CornerB=item_4.Item1, CornerC=item_4.Item2, CornerD=item_4.Item3)

panel_12 = Panel("""0
0
1
1""")
weave_3 = Weave(Pattern=panel_12, Stream0=pt_6, Stream1=move_9.Geometry, NullGaps=False)
panel_13 = Panel("""0
1
2""")
cull_i_2 = CullIndex(List=weave_3, Indices="0", Wrap=True)
cull_i_3 = CullIndex(List=weave_3, Indices=panel_13, Wrap=True)
item_5 = ListItem(List=weave_3, Index=panel_13, Wrap=True)
panel_14 = Panel("2")
partition_2 = PartitionList(List=cull_i_2, Size="4")
partition_3 = PartitionList(List=cull_i_3, Size="4")
intcrv_4 = Interpolate(Vertices=partition_2, Degree=1, Periodic=False, KnotStyle=1)  # -> Curve, Length, Domain
intcrv_5 = Interpolate(Vertices=partition_3, Degree=1, Periodic=False, KnotStyle=1)  # -> Curve, Length, Domain
intcrv_6 = Interpolate(Vertices=item_5, Degree=1, Periodic=False, KnotStyle=1)  # -> Curve, Length, Domain
division_8 = Division(A=H, B="2")
Z_6 = UnitZ(Factor=expr("-x", division_8))
Z_7 = UnitZ(Factor=division_8)
extr = Extrude(Base=intcrv_4.Curve, Direction=Z_7)
extr_2 = Extrude(Base=intcrv_6.Curve, Direction=Z_6)
extr_3 = Extrude(Base=intcrv_5.Curve, Direction=Z_6)
panel_15 = Panel(division_8)
merge_2 = Merge(Data1=flatten(extr_2), Data2=flatten(extr_3))

panel_16 = Panel(tstat.Paths)
item_6 = ListItem(List=move_10.Geometry, Index=0, Wrap=True)

brep_5 = Brep(srf4pt)
brep_6 = Brep(extr)
brep_7 = Brep(merge_2)

join = BrepJoin(Breps=flatten([brep_5, brep_6, brep_7]))  # -> Breps, Closed
move2pt = MoveToPoint(Geometry=join.Breps, PointA=pt_3, PointB=item_6)  # -> Moved, Vector, Transform
multiplication_7 = Multiplication(A=addition_2, B="2")
Y_6 = UnitY(Factor=multiplication_7)
arrlinear = LinearArray(Geometry=[move2pt.Moved, join.Breps], Direction=Y_6, Count=int_3)  # -> Geometry, Transform

join_2 = BrepJoin(Breps=flatten(arrlinear.Geometry))  # -> Breps, Closed
brep_8 = Brep(join_2.Breps)

item_7 = ListItem(List=move_9.Geometry, Index="-2", Wrap=True)
item_8 = ListItem(List=move_9.Geometry, Index=0, Wrap=True)
yz_2 = YZPlane(Origin=[item_7, item_8])
planesrf = PlaneSurface(Plane=yz_2, XSize=Domain(-1000, 1000), YSize=Domain(-1000, 1000))
splitmul = SplitBrepMultiple(Brep=brep_8, Cutters=planesrf)
item_9 = ListItem(List=splitmul, Index=0, Wrap=True)

panel_17 = Panel(splitmul)

dedom2 = DeconstructDomain²(Domain=rebuildsrf)  # -> UComponent, VComponent

number_slider_5 = Slider(9, range=5..100)
# KIRIGAMI UNIT FOR ANALYSIS
panel_18 = Panel("0,0,0")
pt_7 = Point(panel_18)
cos_2 = Cosine(Value=multiplication_3)
sin_2 = Sine(Value=multiplication_3)
multiplication_8 = Multiplication(A=sin_2, B=L_2)
multiplication_9 = Multiplication(A=cos_2, B=L_2)
panel_19 = Panel("""0
0
1
1""")
Y_7 = UnitY(Factor=multiplication_9)

addition_4 = Addition(A=multiplication_9, B=H_3)

panel_20 = Panel("""0
0
1
1""")
panel_21 = Panel("""0
1
2""")
division_9 = Division(A=H_3, B="2")
Z_8 = UnitZ(Factor=expr("-x", division_9))
Z_9 = UnitZ(Factor=division_9)
panel_23 = Panel(division_9)

panel_24 = Panel("""0
1
1
0""")

# ---- group: SIZING
panel_25 = Panel(len)
panel_26 = Panel(len_2)
addition_5 = Addition(A=multiplication_8, B=W_4)
division_10 = Division(A=panel_26, B=addition_5)
division_11 = Division(A=panel_25, B=addition_4)
int_4 = Integer(division_11)
int_5 = Integer(expr("x+2", division_10))
division_12 = Division(A=int_4, B="2")
int_6 = Integer(division_12)

# ----
addition_6 = Addition(A=int_5, B="1")

# ---- group: SIZING (continued)
panel_27 = Panel(addition_6)

# ----
series_4 = Series(Start=W_4, Step="0", Count=panel_27)
series_5 = Series(Start=multiplication_8, Step="0", Count=panel_27)
weave_4 = Weave(Pattern=[0, 1], Stream0=series_4, Stream1=series_5, NullGaps=False)
ma_2 = MassAddition(Input=weave_4)  # -> Result, PartialResults
X_5 = UnitX(Factor=ma_2.PartialResults)
move_11 = Move(Geometry=pt_7, Motion=flatten(X_5))  # -> Geometry, Transform
merge_3 = Merge(Data1=pt_7, Data2=move_11.Geometry)
pt_8 = Point(merge_3)
dispatch_2 = Dispatch(List=pt_8, DispatchPattern=panel_19)  # -> ListA, ListB
pt_9 = Point(dispatch_2.ListA)
move_12 = Move(Geometry=pt_9, Motion=Y_7)  # -> Geometry, Transform
pt_10 = Point(dispatch_2.ListB)

move_13 = Move(Geometry=move_12.Geometry, Motion=Y_4)  # -> Geometry, Transform

weave_5 = Weave(Pattern=panel_20, Stream0=pt_10, Stream1=move_12.Geometry, NullGaps=False)
cull_i_4 = CullIndex(List=weave_5, Indices="0", Wrap=True)
cull_i_5 = CullIndex(List=weave_5, Indices=panel_21, Wrap=True)
item_10 = ListItem(List=weave_5, Index=panel_21, Wrap=True)
partition_4 = PartitionList(List=cull_i_4, Size="4")
partition_5 = PartitionList(List=cull_i_5, Size="4")
intcrv_7 = Interpolate(Vertices=partition_4, Degree=1, Periodic=False, KnotStyle=1)  # -> Curve, Length, Domain
intcrv_8 = Interpolate(Vertices=partition_5, Degree=1, Periodic=False, KnotStyle=1)  # -> Curve, Length, Domain
intcrv_9 = Interpolate(Vertices=item_10, Degree=1, Periodic=False, KnotStyle=1)  # -> Curve, Length, Domain
extr_4 = Extrude(Base=intcrv_7.Curve, Direction=Z_9)
extr_5 = Extrude(Base=intcrv_9.Curve, Direction=Z_8)
extr_6 = Extrude(Base=intcrv_8.Curve, Direction=Z_8)
merge_4 = Merge(Data1=flatten(extr_5), Data2=flatten(extr_6))

weave_6 = Weave(Pattern=panel_24, Stream0=move_12.Geometry, Stream1=move_13.Geometry, NullGaps=False)
partition_6 = PartitionList(List=weave_6, Size="4")
tstat_2 = TreeStatistics(Tree=partition_6)  # -> Paths, Length, Count
lng_2 = ListLength(List=tstat_2.Paths)
subtraction_2 = Subtraction(A=lng_2, B="1")
cull_i_6 = CullIndex(List=tstat_2.Paths, Indices=subtraction_2, Wrap=True)
split_2 = SplitTree(Data=partition_6, Masks=flatten(cull_i_6))  # -> Positive, Negative
item_11 = ListItem(List=split_2.Positive, Index=0, Wrap=True)  # -> Item, Item1, Item2, Item3
srf4pt_2 = _4PointSurface(CornerA=item_11.Item, CornerB=item_11.Item1, CornerC=item_11.Item2, CornerD=item_11.Item3)

item_12 = ListItem(List=flatten(item_10), Index=0, Wrap=True)
item_13 = ListItem(List=flatten(partition_4), Index="3", Wrap=True)

brep_9 = Brep(srf4pt_2)
brep_10 = Brep(extr_4)
brep_11 = Brep(merge_4)

item_14 = ListItem(List=move_12.Geometry, Index=0, Wrap=True)  # -> Item1, Item
join_3 = BrepJoin(Breps=flatten([brep_10, brep_11]))  # -> Breps, Closed
ln_5 = Line(StartPoint=item_14.Item1, EndPoint=item_14.Item)
rotax = RotateAxis(Geometry=item_12, Angle=expr("-x", multiplication_4), Axis=ln_5)  # -> Geometry, Transform
rotax_2 = RotateAxis(Geometry=flatten(item_13), Angle=expr("-x", multiplication_4), Axis=ln_5)  # -> Geometry, Transform
yz_3 = YZPlane(Origin=rotax_2.Geometry)
rotax_3 = RotateAxis(Geometry=move_13.Geometry, Angle=multiplication_4, Axis=ln_5)  # -> Geometry, Transform
rotax_4 = RotateAxis(Geometry=join_3.Breps, Angle=expr("-x", multiplication_4), Axis=ln_5)  # -> Geometry, Transform
rotax_5 = RotateAxis(Geometry=brep_9, Angle=multiplication_4, Axis=ln_5)  # -> Geometry, Transform
item_15 = ListItem(List=rotax_3.Geometry, Index=0, Wrap=True)
move2pt_2 = MoveToPoint(Geometry=flatten(item_15), PointA=rotax.Geometry, PointB=item_15)  # -> Moved, Vector, Transform

Y_8 = UnitY(Factor=1)
move_14 = Move(Geometry=rotax_2.Geometry, Motion=Y_8)  # -> Geometry, Transform
vec2pt = Vector2Pt(PointA=rotax_2.Geometry, PointB=move2pt_2.Moved, Unitize=False)  # -> Vector, Length
vec2pt_2 = Vector2Pt(PointA=rotax_2.Geometry, PointB=move_14.Geometry, Unitize=False)  # -> Vector, Length
angle_4 = Angle(VectorA=vec2pt_2.Vector, VectorB=vec2pt.Vector)  # -> Angle, Reflex

dist_3 = Distance(PointA=rotax_2.Geometry, PointB=move2pt_2.Moved)
vec2pt_3 = Vector2Pt(PointA=rotax_2.Geometry, PointB=move2pt_2.Moved, Unitize=False)  # -> Vector, Length
amp = Amplitude(Vector=vec2pt_3.Vector, Amplitude=dist_3)

join_4 = BrepJoin(Breps=flatten([rotax_5.Geometry, rotax_4.Geometry]))  # -> Breps, Closed
move2pt_3 = MoveToPoint(Geometry=join_4.Breps, PointA=rotax.Geometry, PointB=item_15)  # -> Moved, Vector, Transform
Y_9 = UnitY(Factor=1)
arrlinear_2 = LinearArray(Geometry=[move2pt_3.Moved, join_4.Breps], Direction=amp, Count=int_6)  # -> Geometry, Transform

panel_28 = Panel(join_4.Breps)
join_5 = BrepJoin(Breps=flatten(arrlinear_2.Geometry))  # -> Breps, Closed
brep_12 = Brep(join_5.Breps)

item_16 = ListItem(List=move_13.Geometry, Index="-2", Wrap=True)
item_17 = ListItem(List=move_13.Geometry, Index=0, Wrap=True)
yz_4 = YZPlane(Origin=[item_16, item_17])
planesrf_2 = PlaneSurface(Plane=yz_4, XSize=Domain(-1000, 1000), YSize=Domain(-1000, 1000))
splitmul_2 = SplitBrepMultiple(Brep=brep_12, Cutters=planesrf_2)
item_18 = ListItem(List=splitmul_2, Index=0, Wrap=True)

panel_29 = Panel(splitmul_2)
rotate = Rotate(Geometry=item_18, Angle=angle_4.Angle, Plane=yz_3)  # -> Geometry, Transform

# ----
# MORPHED
bbox_3 = BoundingBox(Content=rotate.Geometry, Plane=PlaneXY(0, 0, 0))  # -> Box, Box_2

srfmorph = SurfaceMorph(
    Geometry=[item_3.Item5, item_3.Item4, brep_4],
    Reference=bbox_3.Box,
    Surface=rebuildsrf,
    UDomain=dedom2.VComponent,
    VDomain=dedom2.UComponent,
    WDomain=number_slider_2)

fmerge_2 = MergeFaces(Brep=rotate.Geometry)  # -> Breps, Before, After
srfmorph_2 = SurfaceMorph(
    Geometry=fmerge_2.Breps,
    Reference=bbox_3.Box,
    Surface=rebuildsrf,
    UDomain=dedom2.VComponent,
    VDomain=dedom2.UComponent,
    WDomain=number_slider_2)

py3 = Python3Script(geometry=flatten(rotate.Geometry), W=H_2)  # -> out, a; inputs geometry: list of Brep; disabled
# ---------- py3: Python ----------
import Rhino
import scriptcontext as sc
import System
import os

def export_step(geo_input, export_path, W):
    sc.doc = Rhino.RhinoDoc.ActiveDoc

    # Create a file name from slider values
    file_name = f"H{W}"
    full_path = os.path.join(export_path, file_name + ".step")

    # Wrap single input in list if necessary
    geo_list = geo_input if isinstance(geo_input, list) else [geo_input]

    obj_ids = []
    success = False

    print(f"Number of Breps: {len(geo_list)}")

    # Create a temporary layer for exporting
    temp_layer_name = "Temp_Export_Layer"
    temp_layer_index = sc.doc.Layers.FindByFullPath(temp_layer_name, True)
    if temp_layer_index == -1:
        temp_layer_index = sc.doc.Layers.Add(temp_layer_name, System.Drawing.Color.Red)

    for i, geo in enumerate(geo_list):
        print(f"Processing Brep {i}...")
        if not geo.IsValid:
            print(f"❌ Brep {i} is invalid, skipping")
            continue

        if isinstance(geo, Rhino.Geometry.Brep):
            attr = Rhino.DocObjects.ObjectAttributes()
            attr.LayerIndex = temp_layer_index
            guid = sc.doc.Objects.AddBrep(geo, attr)
        else:
            print(f"⚠️ Unsupported geometry type at index {i}: {type(geo)}")
            continue

        if guid != System.Guid.Empty:
            obj_ids.append(guid)

    if obj_ids:
        # Select all added objects
        for guid in obj_ids:
            sc.doc.Objects.Select(guid, True)

        # Run export command
        export_command = f'-_Export "{full_path}" _Enter'
        success = Rhino.RhinoApp.RunScript(export_command, False)
        print(f"Export command success: {success}")

    # Clean up: delete added objects
    for guid in obj_ids:
        sc.doc.Objects.Delete(guid, True)

    # Delete the temporary layer (if empty)
    try:
        if temp_layer_index != -1:
            layer = sc.doc.Layers[temp_layer_index]
            if layer and not layer.IsDeleted:
                sc.doc.Layers.Delete(temp_layer_index, True)
    except Exception as e:
        print(f"⚠️ Could not delete temp layer: {e}")

    return "✅ Exported: " + full_path if success else "❌ Export failed"

# === INPUTS from Grasshopper ===
geometry = geometry
W = W

export_path = r'D:\ANSYS BT\10 KirigamiParametric\geometry dataset'

a = export_step(geometry, export_path, W)
# ---------- end py3 ----------
colibri_in = ColibriInputsIterator(R=Toggle(False), H=H_2, ignoreAllWarningMsg=True)  # -> U, IP, H, V_N
panel_30 = Panel(py3.a)

# ==== cluster Colourful: Display objects in bright colours
geo = ClusterInput()
geo_2 = Geometry(geo)
clean = CleanTree(RemoveNulls=True, RemoveInvalid=True, RemoveEmpty=False, Tree=flatten(geo_2))
S = Shader([{diffuse=RGB(11, 125, 222), emission=RGB(3, 38, 67), shine=0.5, specular=RGB(255, 255, 255), transparency=0}, {diffuse=RGB(222, 37, 11), emission=RGB(67, 11, 3), shine=0.5, specular=RGB(255, 255, 255), transparency=0}, {diffuse=RGB(71, 222, 11), emission=RGB(21, 67, 3), shine=0.5, specular=RGB(255, 255, 255), transparency=0}, {diffuse=RGB(222, 194, 11), emission=RGB(67, 58, 3), shine=0.5, specular=RGB(255, 255, 255), transparency=0}])
lng = ListLength(List=clean)
repeat = RepeatData(Data=S, Length=lng)
preview = CustomPreview(Geometry=clean, Shader=repeat)
